# Grasshopper definition cmplx_vectorField.gh (Grasshopper 1.0.7)
# plug-ins: Human

number_slider = Slider(3, range=0..10)
number_slider_2 = Slider(20, range=0..100)
number_slider_3 = Slider(5, range=0..20)
number_slider_4 = Slider(10, range=0..10)
series = Series(Start=Slider(9, range=0..10), Step=number_slider, Count=Slider(2, range=0..10))
item = ListItem(List=series, Index=0, Wrap=True)  # -> Item, Item1
sqgrid = Square(Plane=PlaneXY(0, 0, 0), Size=number_slider_4, ExtentX=number_slider_2, ExtentY=number_slider_2)  # -> Cells, Points
series_2 = Series(Start=0, Step=number_slider_4, Count=number_slider_2)
Z = UnitZ(Factor=series_2)
series_3 = Series(Start=item.Item, Step=1, Count=number_slider)
series_4 = Series(Start=item.Item1, Step=1, Count=number_slider)
move = Move(Geometry=graft(sqgrid.Points), Motion=Z)  # -> flatten(Geometry), Transform
number_slider_5 = Slider(20, range=0..100)
random = Random(Range=Domain(0, 1), Number=number_slider_5, Seed=series_3)
random_2 = Random(Range=Domain(0, 1), Number=number_slider_5, Seed=series_4)
bbox = BoundingBox(Content=move.Geometry, Plane=PlaneXY(0, 0, 0), UnionBox=True)  # -> Box, Box_2
flip = FlipMatrix(Data=random)
flip_2 = FlipMatrix(Data=random_2)
pop3d = Populate3D(Region=bbox.Box, Count=number_slider_5, Seed=Slider(10000, range=0..10000))
item_2 = ListItem(List=flip, Index=0, Wrap=True)  # -> Item, Item1, Item2
item_3 = ListItem(List=flip_2, Index=0, Wrap=True)  # -> Item, Item1, Item2
pt = ConstructPoint(XCoordinate=item_2.Item, YCoordinate=item_2.Item1, ZCoordinate=item_2.Item2)
pt_2 = ConstructPoint(XCoordinate=item_3.Item, YCoordinate=item_3.Item1, ZCoordinate=item_3.Item2)
pl = ConstructPlane(Origin=graft(pop3d), XAxis=pt, YAxis=pt_2)  # -> flatten(Plane)
fspin = SpinForce(Plane=pl, Strength=Slider(100, range=0..100), Radius=Slider(300, range=0..1000), Decay=Slider(6, range=0..10))
mergef = MergeFields(Fields=flatten(fspin))
fline = FieldLine(Field=mergef, Point=move.Geometry, Steps=Slider(40, range=0..100), Accuracy=Slider(3, range=0..10), Method=3)
reb = RebuildCurve(Curve=fline, Degree=Slider(3, range=0..10), Count=Slider(5, range=0..10), Tangents=False)
len = Length(Curve=reb)
curvepoint = PointOnCurve(reb, parameter=0.5)
bnd = Bounds(Numbers=len)
pt_3 = Point(<point referenced from the Rhino model>)
Z_2 = UnitZ(Factor=Slider(10, range=-10..10))
remap = RemapNumbers(Value=len, Source=bnd, Target=Domain(0, 1))  # -> Mapped, Clipped
dist = Distance(PointA=graft(pt_3), PointB=curvepoint)
volume = Volume(Geometry=bbox.Box)  # -> Volume, Centroid
move_2 = Move(Geometry=reb, Motion=Z_2)  # -> Geometry, Transform
gradient = Gradient(
    LowerLimit=0,
    UpperLimit=1,
    Parameter=remap.Mapped,
    stops=[0.322: RGB(89, 193, 115), 0.533: RGB(161, 127, 224), 0.69: RGB(93, 38, 193)])
dom = ConstructDomain(DomainStart=0, DomainEnd=Slider(8.125, range=0..50))
bnd_2 = Bounds(Numbers=dist)
rotate = Rotate(Geometry=move_2.Geometry, Angle=degrees(Slider(360, range=0..360)), Plane=volume.Centroid)  # -> Geometry, Transform
remap_2 = RemapNumbers(Value=dist, Source=bnd_2, Target=dom)  # -> Mapped, Clipped
preview = CustomPreview(Geometry=rotate.Geometry, Material=ColourSwatch(SwatchColor=RGB(191, 191, 191)))
preview_2 = CustomPreview(Geometry=reb, Material=gradient)
previewlw = CustomPreviewLineweights(Geometry=reb, Shader=gradient, Thickness=remap_2.Mapped, Absolute=False)
