# Grasshopper definition cmplx_ArchitecturePattern.gh (Grasshopper 1.0.7)
# plug-ins: Human

number_slider = Slider(100, range=0..200)
# Script Title: Architectural Pattern
# Created by: Michael Hoehn
# Last Modified: 220114
number_slider_2 = Slider(100, range=0..500)
dom = ConstructDomain(DomainStart=Slider(0, range=0..50), DomainEnd=number_slider)
dom_2 = ConstructDomain(DomainStart=Slider(0, range=0..50), DomainEnd=number_slider)
number_slider_3 = Slider(7985, range=0..10000)
pt = ConstructPoint(XCoordinate=0, YCoordinate=0, ZCoordinate=0)
pt_2 = ConstructPoint(XCoordinate=0, YCoordinate=0, ZCoordinate=0)
pt_3 = ConstructPoint(XCoordinate=number_slider_2, YCoordinate=0, ZCoordinate=0)
pt_4 = ConstructPoint(XCoordinate=0, YCoordinate=number_slider_2, ZCoordinate=0)
random = Random(Range=dom, Number=Slider(8, range=0..50), Seed=number_slider_3)
random_2 = Random(Range=dom_2, Number=Slider(10, range=0..50), Seed=number_slider_3)
ln = Line(StartPoint=pt, EndPoint=pt_3)
ln_2 = Line(StartPoint=pt_2, EndPoint=pt_4)
Y = UnitY(Factor=random)
X = UnitX(Factor=random_2)
move = Move(Geometry=ln, Motion=Y)  # -> Geometry, Transform
move_2 = Move(Geometry=ln_2, Motion=X)  # -> Geometry, Transform
merge = Merge(Data1=flatten(move.Geometry), Data2=flatten(move_2.Geometry))
rectangle = Rectangle(Plane=PlaneXY(0, 0, 0), XSize=number_slider_2, YSize=number_slider_2, Radius=0)  # -> Rectangle, Length
srf = Surface(rectangle.Rectangle)
srfsplit = SurfaceSplit(Surface=srf, Curves=merge)
lng = ListLength(List=srfsplit)
dom_3 = ConstructDomain(DomainStart=Slider(1.131, range=0..100), DomainEnd=Slider(13.599, range=0..100))
random_3 = Random(Range=dom_3, Number=lng, Seed=number_slider_3)
Z = UnitZ(Factor=random_3)
extr = Extrude(Base=srfsplit, Direction=Z)
box_bool_max = Slider(20, range=1..50)
box_bool_min = Slider(1, range=1..10)
debrep = DeconstructBrep(Brep=extr)  # -> Faces, Edges, Vertices
area = Area(Geometry=debrep.Faces)  # -> Area, Centroid
pdecon = Deconstruct(Point=area.Centroid)  # -> XComponent, YComponent, ZComponent
dom_4 = ConstructDomain(DomainStart=box_bool_min, DomainEnd=box_bool_max)
sort = SortList(Keys=pdecon.ZComponent, ValuesA=debrep.Faces)  # -> Keys, ValuesA
item = ListItem(List=sort.ValuesA, Index=0, Wrap=True)  # -> Item1, Item
dom_5 = ConstructDomain(DomainStart=Slider(1.653, range=0..100), DomainEnd=Slider(1.409, range=0..100))
dom_6 = ConstructDomain(DomainStart=Slider(1, range=1..10), DomainEnd=Slider(1.17, range=1..10))
area_2 = Area(Geometry=item.Item1)  # -> Area, Centroid
random_4 = Random(Range=dom_5, Number=lng, Seed=expr("((x+987)/2)*2", number_slider_3))
dom_7 = ConstructDomain(DomainStart=Slider(0, range=0..100), DomainEnd=Slider(5.35, range=0..100))
dom_8 = ConstructDomain(DomainStart=Slider(0, range=0..100), DomainEnd=Slider(3.825, range=0..100))
dom_9 = ConstructDomain(DomainStart=Slider(1.775, range=0..100), DomainEnd=Slider(2.975, range=0..100))
scale_nu = ScaleNU(Geometry=extr, Plane=flatten(area_2.Centroid), ScaleX=1, ScaleY=1, ScaleZ=random_4)  # -> Geometry, Transform
lng_2 = ListLength(List=scale_nu.Geometry)
series = Series(Start=number_slider_3, Step=1, Count=lng_2)
random_5 = Random(Range=dom_4, Number=lng_2, Seed=number_slider_3)
round = Round(Number=random_5)  # -> Nearest, Floor, Ceiling
brep = Brep(scale_nu.Geometry)
pop3d = Populate3D(Region=brep, Count=round.Floor, Seed=series)
random_6 = Random(Range=dom_6, Number=lng_2, Seed=expr("x+1", number_slider_3))
random_7 = Random(Range=dom_6, Number=lng_2, Seed=expr("x+2", number_slider_3))
random_8 = Random(Range=dom_6, Number=lng_2, Seed=number_slider_3)
random_9 = Random(Range=dom_7, Number=lng, Seed=expr("x+51", number_slider_3))
random_10 = Random(Range=dom_8, Number=lng, Seed=expr("x+51", number_slider_3))
random_11 = Random(Range=dom_9, Number=lng, Seed=expr("((x+987)/2)*2", number_slider_3))
box = CenterBox(Base=simplify(pop3d), X=graft(random_8), Y=graft(random_6), Z=graft(random_7))  # -> simplify(Box)
volume = Volume(Geometry=box)  # -> Volume, Centroid
scale_nu_2 = ScaleNU(Geometry=box, Plane=volume.Centroid, ScaleX=graft(random_10), ScaleY=graft(random_9), ScaleZ=graft(random_11))  # -> simplify(Geometry), Transform
tstat = TreeStatistics(Tree=scale_nu_2.Geometry)  # -> Paths, Length, Count
random_12 = Random(Range=Domain(0, 1), Number=tstat.Length, Seed=number_slider_3)
dup = DuplicateData(Data="90", Number=tstat.Length, Order=True)  # -> simplify(Data)
round_2 = Round(Number=random_12)  # -> Nearest, Floor, Ceiling
Z_2 = UnitZ(Factor=volume.Centroid)
Y_2 = UnitY(Factor=volume.Centroid)
jitter = Jitter(List=round_2.Nearest, Jitter=1, Seed=2)  # -> Values, Indices
dispatch = Dispatch(List=dup, DispatchPattern=jitter.Values)  # -> simplify(ListA), simplify(ListB)
tstat_2 = TreeStatistics(Tree=dispatch.ListB)  # -> Paths, Length, Count
line = LineSDL(Start=volume.Centroid, Direction=Z_2, Length=1)
line_2 = LineSDL(Start=volume.Centroid, Direction=Y_2, Length=1)
dup_2 = DuplicateData(Data="0", Number=tstat_2.Length, Order=True)  # -> simplify(Data)
merge_2 = Merge(Data1=dispatch.ListA, Data2=dup_2)
jitter_2 = Jitter(List=merge_2, Jitter=1, Seed=2)  # -> Values, Indices
rotax = RotateAxis(Geometry=scale_nu_2.Geometry, Angle=degrees(merge_2), Axis=line)  # -> Geometry, Transform
rotax_2 = RotateAxis(Geometry=rotax.Geometry, Angle=degrees(jitter_2.Values), Axis=line_2)  # -> Geometry, Transform
sdiff = SolidDifference(BrepsA=graft(brep), BrepsB=rotax_2.Geometry)
number_slider_4 = Slider(100, range=0..500)
number_slider_5 = Slider(0.806, range=0..100)
number_slider_6 = Slider(444, range=0..500)
number_slider_7 = Slider(200, range=0..500)
number_slider_8 = Slider(196, range=0..500)
bbox = BoundingBox(Content=flatten(sdiff), Plane=PlaneXY(0, 0, 0), UnionBox=True)  # -> Box, Box_2
number_slider_9 = Slider(50, range=0..500)
dom_10 = ConstructDomain(DomainStart=Slider(0, range=0..100), DomainEnd=Slider(8.099, range=0..100))
dom_11 = ConstructDomain(DomainStart=Slider(0.112, range=0..100), DomainEnd=Slider(0.224, range=0..100))
dom_12 = ConstructDomain(DomainStart=Slider(0, range=0..100), DomainEnd=Slider(7.268, range=0..100))
bbox_2 = BoundingBox(Content=flatten(sdiff), Plane=PlaneXY(0, 0, 0), UnionBox=True)  # -> Box, Box_2
dom_13 = ConstructDomain(DomainStart=Slider(0, range=0..100), DomainEnd=Slider(0.383, range=0..100))
dom_14 = ConstructDomain(DomainStart=Slider(0, range=0..100), DomainEnd=Slider(0.318, range=0..100))
dom_15 = ConstructDomain(DomainStart=Slider(3.781, range=0..100), DomainEnd=Slider(1.705, range=0..100))
bbox_3 = BoundingBox(Content=flatten(sdiff), Plane=PlaneXY(0, 0, 0), UnionBox=True)  # -> Box, Box_2
dom_16 = ConstructDomain(DomainStart=number_slider_5, DomainEnd=number_slider_5)
dom_17 = ConstructDomain(DomainStart=number_slider_5, DomainEnd=number_slider_5)
dom_18 = ConstructDomain(DomainStart=number_slider_5, DomainEnd=number_slider_5)
bbox_4 = BoundingBox(Content=flatten(sdiff), Plane=PlaneXY(0, 0, 0), UnionBox=True)  # -> Box, Box_2
dom_19 = ConstructDomain(DomainStart=Slider(0.167, range=0..100), DomainEnd=Slider(2.883, range=0..100))
dom_20 = ConstructDomain(DomainStart=Slider(0.427, range=0..100), DomainEnd=Slider(1.265, range=0..100))
dom_21 = ConstructDomain(DomainStart=Slider(0.272, range=0..100), DomainEnd=Slider(2.01, range=0..100))
bbox_5 = BoundingBox(Content=flatten(sdiff), Plane=PlaneXY(0, 0, 0), UnionBox=True)  # -> Box, Box_2
dom_22 = ConstructDomain(DomainStart=Slider(0, range=0..100), DomainEnd=Slider(0.422, range=0..100))
dom_23 = ConstructDomain(DomainStart=Slider(0, range=0..100), DomainEnd=Slider(0.318, range=0..100))
dom_24 = ConstructDomain(DomainStart=Slider(3.781, range=0..100), DomainEnd=Slider(8.533, range=0..100))
random_13 = Random(Range=dom_10, Number=number_slider_4, Seed=expr("x+51", number_slider_3))
random_14 = Random(Range=dom_11, Number=number_slider_4, Seed=expr("x+51", number_slider_3))
random_15 = Random(Range=dom_12, Number=number_slider_4, Seed=expr("((x+987)/2)*2", number_slider_3))
pop3d_2 = Populate3D(Region=bbox.Box, Count=number_slider_4, Seed=expr("x*8", number_slider_3))
random_16 = Random(Range=dom_13, Number=number_slider_6, Seed=expr("x+51", number_slider_3))
random_17 = Random(Range=dom_14, Number=number_slider_6, Seed=expr("x+51", number_slider_3))
random_18 = Random(Range=dom_15, Number=number_slider_6, Seed=expr("((x+987)/2)*2", number_slider_3))
random_19 = Random(Range=dom_16, Number=number_slider_7, Seed=expr("x+51", number_slider_3))
random_20 = Random(Range=dom_17, Number=number_slider_7, Seed=expr("x+51", number_slider_3))
pop3d_3 = Populate3D(Region=bbox_2.Box, Count=number_slider_6, Seed=expr("x*4", number_slider_3))
random_21 = Random(Range=dom_18, Number=number_slider_7, Seed=expr("((x+987)/2)*2", number_slider_3))
pop3d_4 = Populate3D(Region=bbox_3.Box, Count=number_slider_7, Seed=expr("x*6", number_slider_3))
random_22 = Random(Range=dom_19, Number=number_slider_9, Seed=expr("x+51", number_slider_3))
random_23 = Random(Range=dom_20, Number=number_slider_9, Seed=expr("x+51", number_slider_3))
random_24 = Random(Range=dom_21, Number=number_slider_9, Seed=expr("((x+987)/2)*2", number_slider_3))
random_25 = Random(Range=dom_22, Number=number_slider_8, Seed=expr("x+51", number_slider_3))
random_26 = Random(Range=dom_23, Number=number_slider_8, Seed=expr("x+51", number_slider_3))
random_27 = Random(Range=dom_24, Number=number_slider_8, Seed=expr("((x+987)/2)*2", number_slider_3))
pop3d_5 = Populate3D(Region=bbox_5.Box, Count=number_slider_8, Seed=expr("x*2", number_slider_3))
pop3d_6 = Populate3D(Region=bbox_4.Box, Count=number_slider_9, Seed=number_slider_3)
box_2 = CenterBox(Base=pop3d_2, X=random_15, Y=random_13, Z=random_14)
box_3 = CenterBox(Base=pop3d_3, X=random_18, Y=random_16, Z=random_17)
box_4 = CenterBox(Base=pop3d_4, X=random_21, Y=random_19, Z=random_20)
box_5 = CenterBox(Base=pop3d_5, X=random_27, Y=random_25, Z=random_26)
box_6 = CenterBox(Base=pop3d_6, X=random_24, Y=random_22, Z=random_23)
volume_2 = Volume(Geometry=box_5)  # -> Volume, Centroid
Y_3 = UnitY(Factor=1)
volume_3 = Volume(Geometry=box_6)  # -> Volume, Centroid
dom_25 = ConstructDomain(DomainStart=Slider(-5.214, range=-10..10), DomainEnd=Slider(0.968, range=-10..10))
dom_26 = ConstructDomain(DomainStart=Slider(-5.214, range=-10..10), DomainEnd=Slider(0.968, range=-10..10))
dom_27 = ConstructDomain(DomainStart=Slider(0.7211, range=0..5), DomainEnd=Slider(0.947, range=0..5))
dom_28 = ConstructDomain(DomainStart=Slider(-5.214, range=-10..10), DomainEnd=Slider(0.968, range=-10..10))
lng_3 = ListLength(List=box_6)
line_3 = LineSDL(Start=volume_2.Centroid, Direction=Y_3, Length=1)
dom_29 = ConstructDomain(DomainStart=Slider(-5.214, range=-10..10), DomainEnd=Slider(-0.83, range=-10..10))
random_28 = Random(Range=dom_25, Number=number_slider_4, Seed=number_slider_3)
random_29 = Random(Range=dom_26, Number=number_slider_6, Seed=number_slider_3)
random_30 = Random(Range=dom_28, Number=number_slider_7, Seed=number_slider_3)
random_31 = Random(Range=dom_27, Number=lng_3, Seed=number_slider_3)
random_32 = Random(Range=dom_29, Number=number_slider_8, Seed=number_slider_3)
Z_3 = UnitZ(Factor=1)
jitter_3 = Jitter(List=random_28, Jitter=1, Seed=2)  # -> Values, Indices
Z_4 = UnitZ(Factor=jitter_3.Values)
rotax_3 = RotateAxis(Geometry=box_5, Angle=degrees(90), Axis=line_3)  # -> Geometry, Transform
jitter_4 = Jitter(List=random_29, Jitter=1, Seed=2)  # -> Values, Indices
Z_5 = UnitZ(Factor=jitter_4.Values)
jitter_5 = Jitter(List=random_30, Jitter=1, Seed=2)  # -> Values, Indices
Z_6 = UnitZ(Factor=jitter_5.Values)
scale = Scale(Geometry=box_6, Center=volume_3.Centroid, Factor=random_31)  # -> Geometry, Transform
move_3 = Move(Geometry=box_2, Motion=Z_4)  # -> Geometry, Transform
jitter_6 = Jitter(List=random_32, Jitter=1, Seed=2)  # -> Values, Indices
Z_7 = UnitZ(Factor=jitter_6.Values)
line_4 = LineSDL(Start=volume_3.Centroid, Direction=Z_3, Length=1)
tstat_3 = TreeStatistics(Tree=line_4)  # -> Paths, Length, Count
move_4 = Move(Geometry=box_3, Motion=Z_5)  # -> Geometry, Transform
random_33 = Random(Range=Domain(0, 1), Number=tstat_3.Length, Seed=number_slider_3)
move_5 = Move(Geometry=box_4, Motion=Z_6)  # -> Geometry, Transform
move_6 = Move(Geometry=rotax_3.Geometry, Motion=Z_7)  # -> Geometry, Transform
dup_3 = DuplicateData(Data="90", Number=tstat_3.Length, Order=True)  # -> simplify(Data)
volume_4 = Volume(Geometry=move_3.Geometry)  # -> Volume, Centroid
round_3 = Round(Number=random_33)  # -> Nearest, Floor, Ceiling
volume_5 = Volume(Geometry=move_5.Geometry)  # -> Volume, Centroid
dom_30 = ConstructDomain(DomainStart=0, DomainEnd=Slider(1.353, range=0..10))
dom_31 = ConstructDomain(DomainStart=0, DomainEnd=Slider(1.353, range=0..10))
scale_nu_3 = ScaleNU(Geometry=scale.Geometry, Plane=volume_3.Centroid, ScaleX=1, ScaleY=Slider(10, range=0..10), ScaleZ=1)  # -> Geometry, Transform
jitter_7 = Jitter(List=round_3.Nearest, Jitter=1, Seed=2)  # -> Values, Indices
dispatch_2 = Dispatch(List=dup_3, DispatchPattern=jitter_7.Values)  # -> simplify(ListA), simplify(ListB)
random_34 = Random(Range=dom_30, Number=number_slider_4, Seed=number_slider_3)
scale_2 = Scale(Geometry=move_3.Geometry, Center=volume_4.Centroid, Factor=random_34)  # -> Geometry, Transform
random_35 = Random(Range=dom_31, Number=number_slider_7, Seed=number_slider_3)
scale_3 = Scale(Geometry=move_5.Geometry, Center=volume_5.Centroid, Factor=random_35)  # -> Geometry, Transform
X_2 = UnitX(Factor=number_slider_2)
sdiff_2 = SolidDifference(BrepsA=box_6, BrepsB=scale_nu_3.Geometry)
tstat_4 = TreeStatistics(Tree=dispatch_2.ListB)  # -> Paths, Length, Count
rev = Reverse(Vector=X_2)
dup_4 = DuplicateData(Data="0", Number=tstat_4.Length, Order=True)  # -> simplify(Data)
Z_8 = UnitZ(Factor=1)
Z_9 = UnitZ(Factor=1)
merge_3 = Merge(Data1=dispatch_2.ListA, Data2=dup_4)  # -> flatten(Result)
Y_4 = UnitY(Factor=number_slider_2)
rev_2 = Reverse(Vector=Y_4)
jitter_8 = Jitter(List=merge_3, Jitter=1, Seed=2)  # -> Values, Indices
rotax_4 = RotateAxis(Geometry=sdiff_2, Angle=degrees(jitter_8.Values), Axis=line_4)  # -> Geometry, Transform
entwine = Entwine(
    Branch00=rotax_4.Geometry,
    Branch01=sdiff,
    Branch02=move_6.Geometry,
    Branch03=move_4.Geometry,
    Branch04=scale_3.Geometry,
    Branch05=scale_2.Geometry,
    FlattenInputs=True)
bbox_6 = BoundingBox(Content=flatten(entwine), Plane=PlaneXY(0, 0, 0), UnionBox=True)  # -> Box, Box_2
volume_6 = Volume(Geometry=bbox_6.Box)  # -> Volume, Centroid
move_7 = Move(Geometry=entwine, Motion=X_2)  # -> simplify(Geometry), Transform
bbox_7 = BoundingBox(Content=flatten(move_7.Geometry), Plane=PlaneXY(0, 0, 0), UnionBox=True)  # -> Box, Box_2
volume_7 = Volume(Geometry=bbox_7.Box)  # -> Volume, Centroid
move_8 = Move(Geometry=entwine, Motion=rev)  # -> simplify(Geometry), Transform
line_5 = LineSDL(Start=volume_7.Centroid, Direction=Z_8, Length=1)
rotax_5 = RotateAxis(Geometry=move_7.Geometry, Angle=degrees(90), Axis=line_5)  # -> simplify(Geometry), Transform
line_6 = LineSDL(Start=volume_6.Centroid, Direction=Z_9, Length=1)
entwine_2 = Entwine(Branch00=move_8.Geometry, Branch01=rotax_5.Geometry, FlattenInputs=True)
rotax_6 = RotateAxis(Geometry=entwine_2, Angle=degrees(90), Axis=line_6)  # -> simplify(Geometry), Transform
move_9 = Move(Geometry=entwine_2, Motion=Y_4)  # -> simplify(Geometry), Transform
move_10 = Move(Geometry=entwine_2, Motion=rev_2)  # -> simplify(Geometry), Transform
bang = ExplodeTree(Data=move_9.Geometry)  # -> Branch0, Branch1
bang_2 = ExplodeTree(Data=move_10.Geometry)  # -> Branch0, Branch1
bang_3 = ExplodeTree(Data=rotax_6.Geometry)  # -> Branch0, Branch1
entwine_3 = Entwine(
    Branch00=entwine,
    Branch01=bang_3.Branch0,
    Branch02=bang_3.Branch1,
    Branch03=move_8.Geometry,
    Branch04=rotax_5.Geometry,
    Branch05=bang.Branch0,
    Branch06=bang.Branch1,
    Branch07=bang_2.Branch0,
    Branch08=bang_2.Branch1,
    FlattenInputs=True)  # -> simplify(Result)
tstat_5 = TreeStatistics(Tree=entwine_3)  # -> Paths, Length, Count
dom_32 = ConstructDomain(DomainStart=Slider(-30, range=-50..50), DomainEnd=Slider(30, range=-50..50))
random_36 = Random(Range=dom_32, Number=tstat_5.Length, Seed=number_slider_3)  # -> simplify(Random)
Z_10 = UnitZ(Factor=random_36)
move_11 = Move(Geometry=entwine_3, Motion=Z_10)  # -> Geometry, Transform
Z_11 = UnitZ(Factor=Slider(-100, range=-100..100))
preview = CustomPreview(Geometry=move_11.Geometry, Material=ColourSwatch(SwatchColor=RGB(255, 255, 255)))
move_12 = Move(Geometry=move_11.Geometry, Motion=Z_11)  # -> Geometry, Transform
wires = BrepWireframe(Brep=[move_11.Geometry, move_12.Geometry], Density=-1)
previewlw = CustomPreviewLineweights(Geometry=wires, Shader=ColourSwatch(SwatchColor=RGB(0, 0, 0)), Thickness=Slider(5, range=0..5), Absolute=False)
preview_2 = CustomPreview(Geometry=move_12.Geometry, Material=ColourSwatch(SwatchColor=RGB(156, 154, 154)))
