# Grasshopper definition cmplx_BallOfStuff.gh (Grasshopper 1.0.7)
# plug-ins: Human, BH.UI.Grasshopper

# Script Title: Ball of Stuff
# Created by: Michael Hoehn
# Last Modified: 220114
number_slider = Slider(41.761, range=0..1000)
sph = Sphere(Base=PlaneXY(0, 0, 0), Radius=number_slider)
L = L(
    {"L 250x90x16.0": 0, "L 250x90x14.0": 1, "L 250x90x12.0": 2, "L 200x100x16.0": 3, "L 200x100x15.0": 4, "L 200x100x14.0": 5, "L 200x100x12.0": 6, "L 200x100x10.0": 7, "L 150x100x14.0": 8, "L 150x100x12.0": 9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}, selected="L 100x65x10.0": 28,
    Component="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",
    Selection=28)
W = W(
    {"W44X335": 0, "W44X290": 1, "W44X262": 2, "W44X230": 3, "W40X655": 4, "W40X593": 5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}, selected="W44X335",
    Component="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",
    Selection=0)
popgeo = PopulateGeometry(Geometry=sph, Count=Slider(32, range=0..10000), Seed=Slider(9998, range=0..10000))
getproperty = GetProperty(Obj=W, PropName="SectionProfile.Edges", Component="{ .GetProperty")
partition = PartitionList(List=popgeo, Size=2)  # -> simplify(Chunks)
flip = FlipMatrix(Data=partition)
join = JoinCurves(Curves=getproperty, Preserve=False)
bang = ExplodeTree(Data=flip)  # -> Branch0, Branch1
ln = Line(StartPoint=bang.Branch0, EndPoint=bang.Branch1)
pl = PlaneNormal(Origin=bang.Branch1, ZAxis=ln)
rev = Reverse(Vector=ln)
orient = Orient(Geometry=join, Source=PlaneXY(0, 0, 0), Target=pl)  # -> Geometry, Transform
move = Move(Geometry=orient.Geometry, Motion=rev)  # -> Geometry, Transform
entwine = Entwine(Branch00=orient.Geometry, Branch01=move.Geometry, FlattenInputs=True)
flip_2 = FlipMatrix(Data=entwine)
eval = EvaluateCurve(Curve=reparameterize(ln), Parameter=Slider(0.5, range=0..1))  # -> Point, Tangent, Angle
loft = Loft(Curves=flip_2, Options={Adjust=False, Closed=False, LoftEnds=0, LoftSimp=0, LoftType=0, Rebuild=10, Refit=0.01})  # -> flatten(Loft)
lng = ListLength(List=loft)
dom = ConstructDomain(DomainStart=Slider(0, range=0..10), DomainEnd=Slider(5.314, range=0..10))
random = Random(Range=dom, Number=lng, Seed=2)
scale = Scale(Geometry=loft, Center=eval.Point, Factor=random)  # -> Geometry, Transform
wires = BrepWireframe(Brep=scale.Geometry, Density=-1)
preview = CustomPreview(Geometry=scale.Geometry, Material=ColourSwatch(SwatchColor=RGB(255, 143, 212)))
previewlw = CustomPreviewLineweights(Geometry=wires, Shader=ColourSwatch(SwatchColor=RGB(0, 0, 0)), Thickness=Slider(0.154, range=0..5), Absolute=False)
