# Grasshopper definition cmplx_Curvature Analysis.gh (Grasshopper 1.0.7)
# plug-ins: MeshEdit Components, Human, Weaverbird

# Script Title: Curvature Analysis
# Created by: Michael Hoehn
# Last Modified: 220116
number_slider = Slider(100, range=0..100)
number_slider_2 = Slider(4, range=0..50)
genes = GenePool(
    Decimals=2,
    Maximum=100,
    Minimum=0,
    Value=[46.97163605, 84.67839439, 69.65934838, 55.51247297, 93.2268124, 48.36295906, 12.23993162, 96.46522319, 2.459846438, 49.41526612, 68.61721644, 36.90029808, 41.54599111, 82.06406756, 45.48003736, 34.44930177, 96.62800589, 68.41099172, 14.85377756, 92.85591691, 25.70462391, 59.23844048, 21.5122853, 64.5319891, 21.43375716])
planesrf = PlaneSurface(Plane=PlaneXY(0, 0, 0), XSize=number_slider, YSize=number_slider)
sdivide = DivideSurface(Surface=planesrf, UCount=number_slider_2, VCount=number_slider_2)  # -> flatten(Points), Normals, Parameters
Z = UnitZ(Factor=genes)
int = Integer(1)
move = Move(Geometry=sdivide.Points, Motion=Z)  # -> Geometry, Transform
addition = Addition(A=number_slider_2, B=int)
countour_density = Slider(9.31, range=0..100)

# ---- group: Camera Settings
number_slider_3 = Slider(307.735, range=0..1000)
number_slider_4 = Slider(270.841, range=0..1000)
number_slider_5 = Slider(683.89, range=0..10000)

# ----
srfgrid = SurfaceFromPoints(Points=move.Geometry, UCount=addition, Interpolate=False)  # -> reparameterize(Surface)
current_frame = Slider(0, range=0..200)
frame_count = Slider(200, range=0..200)
start_point = Slider(25, range=0..100)
Z_2 = UnitZ(Factor=number_slider_4)
Z_3 = UnitZ(Factor=number_slider_3)
area = Area(Geometry=srfgrid)  # -> Area, Centroid
mesh = MeshBrep(
    Brep=srfgrid,
    Settings={GridMaxCount=0, GridMinCount=16, JaggedSeams=False, MaxEdgeLength=0, MinEdgeLength=0.0001, MinTolerance=0, Refine=True, RefineAngle=0, RelativeTolerance=0.65, SimplePlanes=True, Tolerance=0})
edges = BrepEdges(Brep=srfgrid)  # -> Naked, Interior, NonManifold
move_2 = Move(Geometry=area.Centroid, Motion=Z_3)  # -> Geometry, Transform
wbtriangles = WeaverbirdsSplitTrianglesSubdivision(MeshCurves=mesh, Level=1)
triangulate = MeshTriangulate(Mesh=mesh, ShortDiagonal=True)
cir = Circle(Plane=area.Centroid, Radius=number_slider_5)
move_3 = Move(Geometry=cir, Motion=Z_2)  # -> Geometry, Transform
preview = CustomPreview(Geometry=srfgrid, Material=ColourSwatch(SwatchColor=RGB(0, 0, 0)))
debrep = DeconstructBrep(Brep=srfgrid)  # -> Faces, Edges, Vertices
demesh = DeconstructMesh(Mesh=wbtriangles)  # -> Vertices, Faces, Colours, Normals
X = UnitX(Factor=1)
divide = DivideCurve(Curve=move_3.Geometry, Count=frame_count, Kinks=False)  # -> Points, Tangents, Parameters
Y = UnitY(Factor=1)
item = ListItem(List=debrep.Vertices, Index=Slider(0, range=0..4), Wrap=True)
scale = Scale(Geometry=edges.Naked, Center=Point(0, 0, 0), Factor=Slider(1.01, range=0..10))  # -> Geometry, Transform
shift = ShiftList(List=divide.Points, Shift=start_point, Wrap=True)
pdecon = Deconstruct(Point=demesh.Vertices)  # -> XComponent, YComponent, ZComponent
contour = Contour(Shape=srfgrid, Point=item, Direction=Y, Distance=countour_density)
contour_2 = Contour(Shape=srfgrid, Point=item, Direction=X, Distance=countour_density)
crv = Curve(contour_2)
crv_2 = Curve(contour)
srf = Surface(srfgrid)
item_2 = ListItem(List=shift, Index=current_frame, Wrap=invert(True))
amplitude = Slider(820, range=0..10200)
density = Slider(100, range=0..400)
bnd = Bounds(Numbers=pdecon.ZComponent)
# Script Title: Custom High-Res Recorder
# Created by: Michael Hoehn
# Last Modified: 220121
camera_custom = GhPythonScript(location=item_2, target=move_2.Geometry)  # -> out, a; inputs location: Point3d
# ---------- camera_custom: Python ----------
"""Description of Component.
    Inputs:
        x: The x script variable
        y: The y script variable
    Output:
        a: The a output variable"""

import rhinoscriptsyntax as rs
import scriptcontext as sc 

sc.doc = ghdoc

loc = rs.coerce3dpoint(location)
tar = rs.coerce3dpoint(target)

vp = ghdoc.Views.ActiveView.ActiveViewport
vp.SetCameraLocation(loc, False)
vp.SetCameraDirection(tar - loc, True)
# ---------- end camera_custom ----------
edges_2 = BrepEdges(Brep=srf)  # -> Naked, Interior, NonManifold
dedomain = DeconstructDomain(Domain=bnd)  # -> Start, End
preview_2 = CustomPreview(Geometry=srf, Material=ColourSwatch(SwatchColor=RGB(255, 255, 255)))  # disabled
gradient = Gradient(
    LowerLimit=dedomain.Start,
    UpperLimit=dedomain.End,
    Parameter=pdecon.ZComponent,
    stops=[0: RGB(189, 195, 199), 1: RGB(44, 62, 80)])
python = PythonScript(crv=contour_2, Density=density, Scale=amplitude)  # -> out, a, b; inputs crv: Curve, Density: Int32, Scale: Int32
# ---------- python: Python ----------
import rhinoscriptsyntax as rs
import Rhino as rc

a = []
b = []

c = rs.coercecurve(crv)
i = rc.Geometry.Interval(0,1)
rc.Geometry.Curve.Domain.SetValue(c,i)

if (Density < 2):
    Density == 2
    

ScaleFactor = -Scale

for i in range(0, Density):
    Normal = crv.CurvatureAt(i/Density)
    Point = crv.PointAt(i/Density)
    a.append(Point)
    b.append(Point + Normal*ScaleFactor)
# ---------- end python ----------
python_2 = PythonScript(crv=contour, Density=density, Scale=amplitude)  # -> out, a, b; inputs crv: Curve, Density: Int32, Scale: Int32; same code as python
Z_4 = UnitZ(Factor=Slider(31.2751, range=0..100))
move_4 = Move(Geometry=flatten([crv, crv_2, edges_2.Naked]), Motion=Z_4)  # -> Geometry, Transform
join = JoinCurves(Curves=edges_2.Naked, Preserve=False)

intcrv = Interpolate(Vertices=python.b, Degree=3, Periodic=False, KnotStyle=1)  # -> flatten(Curve), Length, Domain
ln = Line(StartPoint=python.a, EndPoint=python.b)
intcrv_2 = Interpolate(Vertices=python_2.b, Degree=3, Periodic=False, KnotStyle=1)  # -> flatten(Curve), Length, Domain
ln_2 = Line(StartPoint=python_2.a, EndPoint=python_2.b)

move_5 = Move(Geometry=flatten([crv, crv_2, edges_2.Naked]), Motion=expr("-x", Z_4))  # -> Geometry, Transform
conmesh = ConstructMesh(Vertices=demesh.Vertices, Faces=demesh.Faces, Colours=gradient)

high_res_view_cap = GhPythonScript(active=Toggle(False), filePath="E:\NFTs\Surface\srf_", frame=current_frame)  # -> out, a; inputs frame: Int32
# ---------- high_res_view_cap: Python ----------
import rhinoscriptsyntax as rs

if active: 
    savedLocation = filePath + str(int(frame)).zfill(4) +".png"
    rs.Command("-ViewCaptureToFile \n\"" + savedLocation + "\"\n")
# ---------- end high_res_view_cap ----------

move_6 = Move(Geometry=flatten(join), Motion=expr("-x", Z_4))  # -> Geometry, Transform
move_7 = Move(Geometry=flatten(join), Motion=Z_4)  # -> Geometry, Transform
ccx = CurveCurve(CurveA=move_4.Geometry, CurveB=graft(move_4.Geometry))  # -> Points, ParamsA, ParamsB
ccx_2 = CurveCurve(CurveA=move_5.Geometry, CurveB=graft(move_5.Geometry))  # -> Points, ParamsA, ParamsB
loft = Loft(Curves=ln, Options={Adjust=False, Closed=False, LoftEnds=0, LoftSimp=0, LoftType=0, Rebuild=10, Refit=0.01})  # -> flatten(Loft)
loft_2 = Loft(Curves=ln_2, Options={Adjust=False, Closed=False, LoftEnds=0, LoftSimp=0, LoftType=0, Rebuild=10, Refit=0.01})  # -> flatten(Loft)

loft_3 = Loft(Curves=intcrv.Curve, Options={Adjust=False, Closed=False, LoftEnds=0, LoftSimp=0, LoftType=0, Rebuild=10, Refit=0.01})
loft_4 = Loft(Curves=intcrv_2.Curve, Options={Adjust=False, Closed=False, LoftEnds=0, LoftSimp=0, LoftType=0, Rebuild=10, Refit=0.01})

wbfacepolys = WeaverbirdsFacePolylines(Mesh=wbtriangles)
explode = Explode(Curve=move_7.Geometry, Recursive=True)  # -> Segments, Vertices
explode_2 = Explode(Curve=move_6.Geometry, Recursive=True)  # -> Segments, Vertices
ln_3 = Line(StartPoint=ccx.Points, EndPoint=ccx_2.Points)
previewlw = CustomPreviewLineweights(
    Geometry=flatten(ln_3),
    Shader=ColourSwatch(SwatchColor=RGB(161, 161, 161)),
    Thickness=Slider(2.0331, range=0..10),
    Absolute=False)
ln_4 = Line(StartPoint=explode.Vertices, EndPoint=explode_2.Vertices)
previewlw_2 = CustomPreviewLineweights(
    Geometry=flatten([move_5.Geometry, move_4.Geometry, ln_4, edges_2.Naked]),
    Shader=ColourSwatch(SwatchColor=RGB(26, 26, 26)),
    Thickness=Slider(10, range=0..10),
    Absolute=False)
entwine = Entwine(Branch00=intcrv.Curve, Branch01=intcrv_2.Curve, FlattenInputs=True)
entwine_2 = Entwine(Branch00=loft_3, Branch01=loft_4, FlattenInputs=True)
entwine_3 = Entwine(Branch00=ln, Branch01=ln_2, FlattenInputs=True)
previewlw_3 = CustomPreviewLineweights(
    Geometry=wbfacepolys,
    Shader=ColourSwatch(SwatchColor=RGB(74, 89, 105)),
    Thickness=Slider(0.5651, range=0..10),
    Absolute=False)
bang = ExplodeTree(Data=entwine_3)  # -> Branch0, Branch1
intcrv_3 = Interpolate(Vertices=python.a, Degree=3, Periodic=False, KnotStyle=1)  # -> flatten(Curve), Length, Domain
intcrv_4 = Interpolate(Vertices=python_2.a, Degree=3, Periodic=False, KnotStyle=1)  # -> flatten(Curve), Length, Domain
preview_3 = CustomPreview(Geometry=entwine_2, Material=ColourSwatch(SwatchColor=RGBA(255, 255, 255, 46)))  # disabled
Z_5 = UnitZ(Factor=Slider(84.537, range=0..100))
move_8 = Move(Geometry=bang.Branch1, Motion=expr("-x", Z_5))  # -> Geometry, Transform
move_9 = Move(Geometry=intcrv_4.Curve, Motion=expr("-x", Z_5))  # -> Geometry, Transform
move_10 = Move(Geometry=bang.Branch0, Motion=Z_5)  # -> Geometry, Transform
move_11 = Move(Geometry=intcrv_3.Curve, Motion=Z_5)  # -> Geometry, Transform
bang_2 = ExplodeTree(Data=entwine)  # -> Branch0, Branch1
entwine_4 = Entwine(Branch00=move_10.Geometry, Branch01=move_8.Geometry, FlattenInputs=True)
Z_6 = UnitZ(Factor=Slider(84.537, range=0..100))
move_12 = Move(Geometry=bang_2.Branch1, Motion=expr("-x", Z_6))  # -> Geometry, Transform
move_13 = Move(Geometry=bang_2.Branch0, Motion=Z_6)  # -> Geometry, Transform
swatch = ColourSwatch(SwatchColor=RGB(151, 160, 168))
previewlw_4 = CustomPreviewLineweights(Geometry=scale.Geometry, Shader=swatch, Thickness=Slider(10, range=0..10), Absolute=False)
entwine_5 = Entwine(
    Branch00=move_11.Geometry,
    Branch01=move_13.Geometry,
    Branch02=move_12.Geometry,
    Branch03=move_9.Geometry,
    FlattenInputs=True)
previewlw_5 = CustomPreviewLineweights(
    Geometry=entwine_4,
    Shader=ColourSwatch(SwatchColor=RGB(121, 122, 122)),
    Thickness=Slider(0, range=0..10),
    Absolute=False)
previewlw_6 = CustomPreviewLineweights(Geometry=entwine_5, Shader=swatch, Thickness=Slider(6.7852, range=0..10), Absolute=False)
