# Grasshopper definition cmplx_square.gh (Grasshopper 1.0.7)
# plug-ins: Human

# Script Title: Destroy a Square
# Created by: Michael Hoehn
# Last Modified: 220114
srf = Surface(<surface referenced from the Rhino model>)
edges = BrepEdges(Brep=srf)  # -> Naked, Interior, NonManifold
join = JoinCurves(Curves=edges.Naked, Preserve=False)
offset = OffsetCurve(Curve=join, Distance=Slider(21, range=0..100), Plane=PlaneXY(0, 0, 0), Corners=1)
number_slider = Slider(4926, range=0..10000)
crv = Curve(offset)
srf_2 = Surface(crv)
popgeo = PopulateGeometry(Geometry=crv, Count=Slider(100, range=0..1000), Seed=number_slider)
srfsplit = SurfaceSplit(Surface=srf_2, Curves=join)
partition = PartitionList(List=popgeo, Size=2)  # -> simplify(Chunks)
item = ListItem(List=srfsplit, Index=0, Wrap=True)
flip = FlipMatrix(Data=partition)
bang = ExplodeTree(Data=flip)  # -> Branch0, Branch1
ln = Line(StartPoint=bang.Branch0, EndPoint=bang.Branch1)
srfsplit_2 = SurfaceSplit(Surface=item, Curves=ln)
lng = ListLength(List=srfsplit_2)
dom = ConstructDomain(DomainStart=0, DomainEnd=Slider(200, range=0..500))
random = Random(Range=dom, Number=lng, Seed=number_slider)
Z = UnitZ(Factor=random)
extr = Extrude(Base=srfsplit_2, Direction=Z)
debrep = DeconstructBrep(Brep=extr)  # -> Faces, Edges, Vertices
area = Area(Geometry=debrep.Faces)  # -> Area, Centroid
pdecon = Deconstruct(Point=area.Centroid)  # -> XComponent, YComponent, ZComponent
sort = SortList(Keys=pdecon.ZComponent, ValuesA=debrep.Faces)  # -> Keys, ValuesA
item_2 = ListItem(List=sort.ValuesA, Index=-1, Wrap=True)
srf_3 = Surface(flatten(item_2))
crv_2 = Curve(srf_3)
srf_4 = Surface(crv_2)
popgeo_2 = PopulateGeometry(Geometry=crv_2, Count=Slider(10, range=0..1000), Seed=number_slider)  # -> simplify(Population)
srfsplit_3 = SurfaceSplit(Surface=srf_4, Curves=join)
partition_2 = PartitionList(List=popgeo_2, Size=2)  # -> simplify(Chunks)
item_3 = ListItem(List=srfsplit_3, Index=0, Wrap=True)
tstat = TreeStatistics(Tree=partition_2)  # -> Paths, Length, Count
branch = TreeBranch(Tree=partition_2, Path=tstat.Paths, MaintainPaths=False)
flip_2 = FlipMatrix(Data=branch)
bang_2 = ExplodeTree(Data=flip_2)  # -> Branch0, Branch1
ln_2 = Line(StartPoint=bang_2.Branch0, EndPoint=bang_2.Branch1)
srfsplit_4 = SurfaceSplit(Surface=item_3, Curves=ln_2)
lng_2 = ListLength(List=srfsplit_4)
dom_2 = ConstructDomain(DomainStart=0, DomainEnd=Slider(40, range=0..100))
random_2 = Random(Range=dom_2, Number=lng_2, Seed=number_slider)
Z_2 = UnitZ(Factor=random_2)
extr_2 = Extrude(Base=srfsplit_4, Direction=Z_2)  # -> flatten(Extrusion)
merge = Merge(Data1=flatten(extr), Data2=flatten(extr_2))
wires = BrepWireframe(Brep=merge, Density=-1)
volume = Volume(Geometry=merge)  # -> Volume, Centroid
pdecon_2 = Deconstruct(Point=volume.Centroid)  # -> XComponent, YComponent, ZComponent
bnd = Bounds(Numbers=flatten(pdecon_2.ZComponent))
dedomain = DeconstructDomain(Domain=bnd)  # -> Start, End
gradient = Gradient(
    LowerLimit=dedomain.End,
    UpperLimit=dedomain.Start,
    Parameter=flatten(pdecon_2.ZComponent),
    stops=[0: RGB(255, 255, 255), 0.869: RGB(0, 0, 0)])
previewlw = CustomPreviewLineweights(Geometry=wires, Shader=ColourSwatch(SwatchColor=RGB(79, 79, 79)), Thickness=Slider(3.251, range=0..10), Absolute=False)
preview = CustomPreview(Geometry=merge, Material=gradient)
