# Grasshopper definition Axial Mirrored Lines_WIP.gh (Grasshopper 1.0.7)
# plug-ins: Pufferfish, Human, Weaverbird

# ---- group: Randomize these
number_slider = Slider(400, range=0..1000)
number_slider_2 = Slider(74, range=0..100)
dom = ConstructDomain(DomainStart=Slider(21.716, range=0..100), DomainEnd=Slider(78.173, range=0..100))
dom_2 = ConstructDomain(DomainStart=Slider(38.824, range=0..100), DomainEnd=Slider(99.181, range=0..100))

# ----
number_slider_3 = Slider(1564, range=0..10000)
# Script Title: Sudo-random Number Generator
# Created by: Michael Hoehn
# Last Modified: 220124
box = CenterBox(Base=PlaneXY(0, 0, 0), X=number_slider_2, Y=number_slider_2, Z=number_slider_2)
pop3d = Populate3D(Region=box, Count=number_slider, Seed=number_slider_3)
random = Random(Range=dom_2, Number=1, Seed=expr("x+3", number_slider_3))
random_2 = Random(Range=dom_2, Number=1, Seed=expr("x+4", number_slider_3))
random_3 = Random(Range=dom_2, Number=1, Seed=expr("x+5", number_slider_3))
number_slider_4 = Slider(200, range=0..300)  # disabled
random_4 = Random(Range=dom, Number=1, Seed=expr("x+3", number_slider_3))
random_5 = Random(Range=dom, Number=1, Seed=expr("x+4", number_slider_3))
random_6 = Random(Range=dom, Number=1, Seed=expr("x+5", number_slider_3))
number_slider_5 = Slider(0, range=0..10000)  # disabled
number_slider_6 = Slider(9, range=0..100)  # disabled

# ---- group: Random Vector Flip
random_7 = Random(Range=Domain(0, 1), Number=1, Seed=expr("x+10", number_slider_3))
round = Round(Number=random_7)  # -> Nearest, Floor, Ceiling
Y = UnitY(Factor=1)
rev = Reverse(Vector=Y)
filter = StreamFilter(Gate=round.Nearest, Stream0=rev, Stream1=Y)

# ----
dom_3 = ConstructDomain(DomainStart=random, DomainEnd=random_4)
dom_4 = ConstructDomain(DomainStart=random_2, DomainEnd=random_5)
dom_5 = ConstructDomain(DomainStart=random_3, DomainEnd=random_6)
box_2 = CenterBox(Base=PlaneXY(0, 0, 0), X=number_slider_6, Y=number_slider_6, Z=number_slider_6)  # disabled
random_8 = Random(Range=dom_5, Number=number_slider, Seed=expr("x+2", number_slider_3))
random_9 = Random(Range=dom_4, Number=number_slider, Seed=expr("x+1", number_slider_3))
random_10 = Random(Range=dom_3, Number=number_slider, Seed=number_slider_3)
number_slider_7 = Slider(100, range=0..100)  # disabled
pop3d_2 = Populate3D(Region=box_2, Count=number_slider_4, Seed=number_slider_5)  # disabled
Y_2 = UnitY(Factor=1)  # disabled
line = LineSDL(Start=pop3d_2, Direction=Y_2, Length=number_slider_7)  # disabled

# ----
# Script Title: Custom High-Res Recorder
# Created by: Michael Hoehn
# Last Modified: 220121
panel = Panel("E:\NFTs\Surface\srf_")
high_res_view_cap = GhPythonScript(active=Toggle(False), filePath=panel)  # -> out, a; inputs frame: Int32
# ---------- high_res_view_cap: Python ----------
import rhinoscriptsyntax as rs

if active: 
    savedLocation = filePath + str(int(frame)).zfill(4) +".png"
    rs.Command("-ViewCaptureToFile \n\"" + savedLocation + "\"\n")
# ---------- end high_res_view_cap ----------

number_slider_8 = Slider(0.5, range=0..1)  # disabled
number_slider_9 = Slider(0.5, range=0..1)  # disabled

random_11 = Random(Range=Domain(0, 1), Number=1, Seed=expr("x+6", number_slider_3))
round_2 = Round(Number=random_11)  # -> Nearest, Floor, Ceiling
X = UnitX(Factor=1)
rev_2 = Reverse(Vector=X)
filter_2 = StreamFilter(Gate=round_2.Nearest, Stream0=rev_2, Stream1=X)

line_2 = LineSDL(Start=pop3d, Direction=filter, Length=random_10)
dom_6 = ConstructDomain(DomainStart=number_slider_9, DomainEnd=number_slider_8)  # disabled
end = EndPoints(Curve=line_2)  # -> Start, End
lng = ListLength(List=line)  # disabled
pt = Point(end.End)
random_12 = Random(Range=dom_6, Number=lng, Seed=expr("x+1", number_slider_5))  # -> graft(Random); disabled
line_3 = LineSDL(Start=pt, Direction=filter_2, Length=random_9)

random_13 = Random(Range=Domain(0, 1), Number=1, Seed=expr("x+12", number_slider_3))
Z = UnitZ(Factor=1)
round_3 = Round(Number=random_13)  # -> Nearest, Floor, Ceiling
rev_3 = Reverse(Vector=Z)
filter_3 = StreamFilter(Gate=round_3.Nearest, Stream0=rev_3, Stream1=Z)

# ---- group: Random Vector Flip
random_14 = Random(Range=Domain(0, 1), Number=1, Seed=expr("x+11", number_slider_3))
round_4 = Round(Number=random_14)  # -> Nearest, Floor, Ceiling
Y_3 = UnitY(Factor=1)
rev_4 = Reverse(Vector=Y_3)
filter_4 = StreamFilter(Gate=round_4.Nearest, Stream0=rev_4, Stream1=Y_3)

# ----
shatter = Shatter(Curve=reparameterize(graft(line)), Parameters=random_12)  # -> simplify(Segments); disabled
end_2 = EndPoints(Curve=line_3)  # -> Start, End
pt_2 = Point(end_2.End)
item = ListItem(List=shatter, Index=0, Wrap=True)  # -> Item, Item1; disabled
line_4 = LineSDL(Start=pt_2, Direction=filter_3, Length=random_8)
end_3 = EndPoints(Curve=item.Item1)  # -> flatten(Start), End; disabled
end_4 = EndPoints(Curve=line_4)  # -> Start, End
number_slider_10 = Slider(45, range=0..360)  # disabled
pt_3 = Point(end_4.End)
xz = XZPlane(Origin=end_3.Start)  # disabled
number_slider_11 = Slider(0.5, range=0..1)  # disabled
number_slider_12 = Slider(0.5, range=0..1)  # disabled
line_5 = LineSDL(Start=pt_3, Direction=filter_4, Length=random_9)
rotate = Rotate(Geometry=xz, Angle=degrees(number_slider_10), Plane=end_3.Start)  # -> Geometry, Transform; disabled

random_15 = Random(Range=Domain(0, 1), Number=1, Seed=expr("x+13", number_slider_3))
round_5 = Round(Number=random_15)  # -> Nearest, Floor, Ceiling
X_2 = UnitX(Factor=1)
rev_5 = Reverse(Vector=X_2)
filter_5 = StreamFilter(Gate=round_5.Nearest, Stream0=rev_5, Stream1=X_2)

line_6 = Line(flatten(item.Item))  # disabled
mirror = Mirror(Geometry=flatten(item.Item1), Plane=rotate.Geometry)  # -> Geometry, Transform; disabled
lng_2 = ListLength(List=mirror.Geometry)  # disabled
dom_7 = ConstructDomain(DomainStart=number_slider_12, DomainEnd=number_slider_11)  # disabled
end_5 = EndPoints(Curve=line_5)  # -> Start, End
random_16 = Random(Range=dom_7, Number=lng_2, Seed=expr("x+2", number_slider_5))  # -> graft(Random); disabled
pt_4 = Point(end_5.End)
line_7 = LineSDL(Start=pt_4, Direction=filter_5, Length=random_9)
shatter_2 = Shatter(Curve=reparameterize(graft(mirror.Geometry)), Parameters=random_16)  # -> simplify(Segments); disabled

random_17 = Random(Range=Domain(0, 1), Number=1, Seed=expr("x+16", number_slider_3))
Z_2 = UnitZ(Factor=1)
round_6 = Round(Number=random_17)  # -> Nearest, Floor, Ceiling
rev_6 = Reverse(Vector=Z_2)
filter_6 = StreamFilter(Gate=round_6.Nearest, Stream0=rev_6, Stream1=Z_2)

end_6 = EndPoints(Curve=line_7)  # -> Start, End
item_2 = ListItem(List=shatter_2, Index=0, Wrap=True)  # -> Item, Item1; disabled
pt_5 = Point(end_6.End)
end_7 = EndPoints(Curve=item_2.Item1)  # -> flatten(Start), End; disabled
number_slider_13 = Slider(45, range=0..360)  # disabled
line_8 = LineSDL(Start=pt_5, Direction=filter_6, Length=random_8)
xz_2 = XZPlane(Origin=end_7.Start)  # disabled
number_slider_14 = Slider(0.5, range=0..1)  # disabled
number_slider_15 = Slider(0.5, range=0..1)  # disabled
merge = Merge(Data1=line_2, Data2=line_3, Data3=line_4, Data4=line_5, Data5=line_7, Data6=line_8)
rotate_2 = Rotate(Geometry=xz_2, Angle=degrees(number_slider_13), Plane=end_7.Start)  # -> Geometry, Transform; disabled
join = JoinCurves(Curves=merge, Preserve=False)
line_9 = Line(flatten(item_2.Item))  # disabled
mirror_2 = Mirror(Geometry=flatten(item_2.Item1), Plane=rotate_2.Geometry)  # -> Geometry, Transform; disabled
lng_3 = ListLength(List=mirror_2.Geometry)  # disabled
dom_8 = ConstructDomain(DomainStart=number_slider_15, DomainEnd=number_slider_14)  # disabled
number_slider_16 = Slider(12.378, range=0..100)  # disabled
number_slider_17 = Slider(100, range=0..100)  # disabled
random_18 = Random(Range=dom_8, Number=lng_3, Seed=expr("x+3", number_slider_5))  # -> graft(Random); disabled
dom_9 = ConstructDomain(DomainStart=Slider(0.024, range=0..10), DomainEnd=Slider(1.266, range=0..10))
lng_4 = ListLength(List=join)
random_19 = Random(Range=dom_9, Number=lng_4, Seed=expr("x+5", number_slider_3))
shatter_3 = Shatter(Curve=reparameterize(graft(mirror_2.Geometry)), Parameters=random_18)  # -> simplify(Segments); disabled
dom_10 = ConstructDomain(DomainStart=number_slider_16, DomainEnd=number_slider_17)  # disabled
parampipemsh = ParameterPipeMesh(
    Curve=join,
    Radius=random_19,
    ParametersU=[0, 0.1, 0.2, 0.3, 0.4, 0.5, 0.6, 0.7, 0.8, 0.9, 1],
    ParametersV=[0, 0.25, 0.5, 0.75, 1],
    Weighted=False,
    Lengths=invert(False),
    Angle=0,
    Rotation=0,
    EndType=1,
    Triangulate=False)
item_3 = ListItem(List=shatter_3, Index=0, Wrap=True)  # -> Item, Item1; disabled
lng_5 = ListLength(List=flatten(item_3.Item1))  # disabled
random_20 = Random(Range=dom_10, Number=lng_5, Seed=expr("x+4", number_slider_5))  # disabled
Z_3 = UnitZ(Factor=random_20)  # disabled
end_8 = EndPoints(Curve=item_3.Item1)  # -> flatten(Start), End; disabled
mesh = Mesh(flatten(parampipemsh))
lng_6 = ListLength(List=mesh)
rev_7 = Reverse(Vector=Z_3)  # disabled
dom_11 = ConstructDomain(DomainStart=0, DomainEnd=lng_6)
move = Move(Geometry=end_8.Start, Motion=rev_7)  # -> Geometry, Transform; disabled
random_21 = Random(Range=dom_11, Number=1, Seed=2)
round_7 = Round(Number=random_21)  # -> Nearest, Floor, Ceiling
line_10 = Line(flatten(item_3.Item))  # disabled
ln = Line(StartPoint=end_8.Start, EndPoint=move.Geometry)  # disabled
dispdexs = DispatchIndices(List=mesh, Indices=round_7.Ceiling)  # -> AtI, NotI
merge_2 = Merge(Data1=line_6, Data2=line_9, Data3=line_10, Data4=ln)  # -> flatten(Result); disabled
mesh_2 = Mesh(flatten(dispdexs.NotI))
mesh_3 = Mesh(flatten(dispdexs.AtI))
join_2 = JoinCurves(Curves=merge_2, Preserve=False)  # disabled
demesh = DeconstructMesh(Mesh=mesh_2)  # -> Vertices, Faces, Colours, Normals
demesh_2 = DeconstructMesh(Mesh=mesh_3)  # -> Vertices, Faces, Colours, Normals
conmesh = ConstructMesh(Vertices=demesh.Vertices, Faces=demesh.Faces, Colours=ColourSwatch(SwatchColor=RGB(227, 227, 227)))
conmesh_2 = ConstructMesh(Vertices=demesh_2.Vertices, Faces=demesh_2.Faces, Colours=ColourSwatch(SwatchColor=RGB(255, 0, 0)))
wbfacepolys = WeaverbirdsFacePolylines(Mesh=conmesh)  # -> flatten(Polygons)
wbfacepolys_2 = WeaverbirdsFacePolylines(Mesh=conmesh_2)  # -> flatten(Polygons)
number_slider_18 = Slider(0.038, range=0..10)  # disabled
number_slider_19 = Slider(0.384, range=0..10)  # disabled
previewlw = CustomPreviewLineweights(
    Geometry=wbfacepolys,
    Shader=ColourSwatch(SwatchColor=RGB(0, 0, 0)),
    Thickness=Slider(2.807, range=0..10),
    Absolute=False)
previewlw_2 = CustomPreviewLineweights(
    Geometry=wbfacepolys_2,
    Shader=ColourSwatch(SwatchColor=RGB(0, 0, 0)),
    Thickness=Slider(2.807, range=0..10),
    Absolute=False)
dom_12 = ConstructDomain(DomainStart=number_slider_18, DomainEnd=number_slider_19)  # disabled
lng_7 = ListLength(List=join_2)  # disabled
random_22 = Random(Range=dom_12, Number=lng_7, Seed=expr("x+5", number_slider_5))  # disabled
parampipemsh_2 = ParameterPipeMesh(
    Curve=join_2,
    Radius=random_22,
    ParametersU=[0, 0.1, 0.2, 0.3, 0.4, 0.5, 0.6, 0.7, 0.8, 0.9, 1],
    ParametersV=[0, 0.25, 0.5, 0.75, 1],
    Weighted=False,
    Lengths=invert(False),
    Angle=0,
    Rotation=0,
    EndType=0,
    Triangulate=False)  # disabled
createatts = CreateAttributes(LayerName=Slider(9, range=0..10), enableFullPath=True)
layers = CreateModifyLayers(DeleteLayer=False, enableFullPath=False)  # -> LayerNames, LayerFullPath; disabled
demesh_3 = DeconstructMesh(Mesh=parampipemsh_2)  # -> Vertices, Faces, Colours, Normals; disabled
swatch = ColourSwatch(SwatchColor=RGB(235, 235, 235))  # disabled
bake = BakeGeometry(
    Bake=Toggle(False),
    Geometry=flatten([conmesh_2, conmesh]),
    Attributes=createatts,
    DeleteOldBakes=False,
    PreserveTrees=False)
conmesh_3 = ConstructMesh(Vertices=demesh_3.Vertices, Faces=demesh_3.Faces, Colours=swatch)  # disabled
number_slider_20 = Slider(2.807, range=0..10)  # disabled
swatch_2 = ColourSwatch(SwatchColor=RGB(0, 0, 0))  # disabled
wbfacepolys_3 = WeaverbirdsFacePolylines(Mesh=conmesh_3)  # -> flatten(Polygons); disabled
mesh_4 = Mesh(flatten(conmesh_3))  # disabled
previewlw_3 = CustomPreviewLineweights(Geometry=wbfacepolys_3, Shader=swatch_2, Thickness=number_slider_20, Absolute=False)  # disabled
