# Grasshopper definition cmplx_DiscreteLines.gh (Grasshopper 1.0.7)
# plug-ins: Pufferfish, NudiBranch, Human, Weaverbird

number_slider = Slider(7, range=0..100)
box = CenterBox(Base=PlaneXY(0, 0, 0), X=number_slider, Y=number_slider, Z=number_slider)
pt = ConstructPoint(XCoordinate=0, YCoordinate=0, ZCoordinate=Slider(541, range=0..1000))
box_2 = Box(box)
sph = Sphere(Base=PlaneXY(0, 0, 0), Radius=Slider(247, range=0..500))
brep = Brep(<brep referenced from the Rhino model>)
wbpyramid = WeaverbirdsMeshPyramid(
    Plane=PlaneXY(0, 0, 0),
    Width=Slider(196, range=0..1000),
    NumberOfSides=Slider(4, range=0..10),
    TopPoint=pt,
    BasePolygonMethod=True,
    FillStrategy=1)
timer = Timer(TimerInterval=20, Target=satellite)
satellite = Satellite(Geometry=brep, SatNumber=Slider(20, range=0..100), Factor=1, Seed=2, Run=Toggle(False))
brep_cp = BrepClosestPoint(Point=satellite, Brep=brep)  # -> graft(Point), Normal, Distance
meshcp = MeshClosestPoint(Point=satellite, Mesh=wbpyramid)  # -> graft(Point), Index, Parameter
u = ParametersU([0, 0.1, 0.2, 0.3, 0.4, 0.5, 0.6, 0.7, 0.8, 0.9, 1])
v = ParametersV([0, 0.25, 0.5, 0.75, 1])
rec = DataRecorder(simplify(brep_cp.Point), DataLimit=-10, RecordData=True)
panel = Panel(v)
panel_2 = Panel(u)
vecworld = VectorWorld(Plane=PlaneXY(0, 0, 0), DirectionType=Slider(0, range=0..2), Dimensionality=Toggle(False))  # -> Vectors, Lines
dpline = DiscretePolyline(References=rec, Targets=vecworld.Vectors, KeepLength=False)
tstat = TreeStatistics(Tree=dpline)  # -> Paths, Length, Count
number_slider_2 = Slider(3, range=0..10)
dom = ConstructDomain(DomainStart=Slider(1, range=0..10), DomainEnd=Slider(5, range=0..10))
range = Range(Domain=Domain(0, 1), Steps=Slider(4, range=0..50))
random = Random(Range=dom, Number=tstat.Count, Seed=2)  # -> simplify(graft(Random))
parampipemsh = ParameterPipeMesh(
    Curve=dpline,
    Radius=random,
    ParametersV=range,
    Weighted=Toggle(True),
    Lengths=Toggle(True),
    Angle=0,
    Rotation=Slider(0, range=0..1000),
    EndType=Slider(1, range=0..2),
    Triangulate=Toggle(False))
wbfacepolys = WeaverbirdsFacePolylines(Mesh=parampipemsh)
mesh = Mesh(parampipemsh)
crv = Curve(wbfacepolys)
previewlw = CustomPreviewLineweights(Geometry=wbfacepolys, Shader=ColourSwatch(SwatchColor=RGB(178, 178, 178)), Absolute=False)
preview = CustomPreview(Geometry=parampipemsh, Material=ColourSwatch(SwatchColor=RGB(178, 178, 178)))
