# Grasshopper definition Fracture.gh (Grasshopper 1.0.7)

number_slider = Slider(100, range=0..1000)
number_slider_2 = Slider(100, range=0..100)
number_slider_3 = Slider(9854, range=0..10000)
number_slider_4 = Slider(20, range=0..50)
number_slider_5 = Slider(10, range=0..1000)
number_slider_6 = Slider(125, range=0..1000)
box = CenterBox(Base=PlaneXY(0, 0, 0), X=number_slider_2, Y=number_slider_2, Z=number_slider_2)
sph = Sphere(Base=PlaneXY(0, 0, 0), Radius=number_slider_2)
cone = Cone(Base=PlaneXY(0, 0, 0), Radius=number_slider, Length=expr("x*2", number_slider))  # -> Cone, Tip
box_2 = Box(box)
series = Series(Start=0, Step=Slider(10, range=0..10), Count=Slider(100, range=0..100))
dom = ConstructDomain(DomainStart=number_slider_5, DomainEnd=number_slider_6)
dom_2 = ConstructDomain(DomainStart=number_slider_5, DomainEnd=number_slider_6)
dom_3 = ConstructDomain(DomainStart=number_slider_5, DomainEnd=number_slider_6)
number_slider_7 = Slider(100, range=0..100)
pt = ConstructPoint(XCoordinate=0, YCoordinate=0, ZCoordinate=0)
X = UnitX(Factor=series)
random = Random(Range=dom_2, Number=number_slider_4, Seed=expr("x+1", number_slider_3))
random_2 = Random(Range=dom_3, Number=number_slider_4, Seed=expr("x+1", number_slider_3))
random_3 = Random(Range=dom, Number=number_slider_4, Seed=number_slider_3)
pop3d = Populate3D(Region=cone.Cone, Count=number_slider_4, Seed=number_slider_3)
box_3 = CenterBox(Base=pop3d, X=random_3, Y=random, Z=random_2)
Y = UnitY(Factor=X)
move = Move(Geometry=pt, Motion=X)  # -> Geometry, Transform
box_4 = Box(box_3)
move_2 = Move(Geometry=graft(move.Geometry), Motion=Y)  # -> Geometry, Transform
sdiff = SolidDifference(BrepsA=cone.Cone, BrepsB=box_4)
series_2 = Series(Start=0, Step=Slider(200, range=0..1000), Count=Slider(10, range=0..100))
item = ListItem(List=sdiff, Index=Slider(1, range=0..1), Wrap=True)
X_2 = UnitX(Factor=series_2)
move_3 = Move(Geometry=item, Motion=X_2)  # -> Geometry, Transform
Y_2 = UnitY(Factor=series_2)
number_slider_8 = Slider(54.06, range=0..360)
move_4 = Move(Geometry=graft(move_3.Geometry), Motion=Y_2)  # -> Geometry, Transform
tstat = TreeStatistics(Tree=move_4.Geometry)  # -> Paths, Length, Count
area = Area(Geometry=move_4.Geometry)  # -> Area, Centroid
X_3 = UnitX(Factor=1)
ma = MassAddition(Input=tstat.Length)  # -> Result, PartialResults
line = LineSDL(Start=area.Centroid, Direction=X_3, Length=1)
series_3 = Series(Start=0, Step=number_slider_8, Count=ma.Result)
bnd = Bounds(Numbers=series_3)
remap = RemapNumbers(Value=series_3, Source=bnd, Target=Domain(0, 360))  # -> Mapped, Clipped
partition = PartitionList(List=remap.Mapped, Size=tstat.Count)  # -> simplify(Chunks)
rotax = RotateAxis(Geometry=move_4.Geometry, Angle=degrees(partition), Axis=line)  # -> Geometry, Transform
area_2 = Area(Geometry=rotax.Geometry)  # -> Area, Centroid
tstat_2 = TreeStatistics(Tree=rotax.Geometry)  # -> Paths, Length, Count
Z = UnitZ(Factor=1)
ma_2 = MassAddition(Input=tstat_2.Length)  # -> Result, PartialResults
line_2 = LineSDL(Start=area_2.Centroid, Direction=Z, Length=1)
series_4 = Series(Start=0, Step=number_slider_8, Count=ma_2.Result)
bnd_2 = Bounds(Numbers=series_4)
remap_2 = RemapNumbers(Value=series_4, Source=bnd_2, Target=Domain(0, 360))  # -> Mapped, Clipped
partition_2 = PartitionList(List=remap_2.Mapped, Size=tstat_2.Count)  # -> simplify(Chunks)
rotax_2 = RotateAxis(Geometry=rotax.Geometry, Angle=degrees(partition_2), Axis=line_2)  # -> Geometry, Transform
number_slider_9 = Slider(43.408, range=1..50)
series_5 = Series(Start=0, Step=Slider(300, range=0..1000), Count=10)
Z_2 = UnitZ(Factor=series_5)
move_5 = Move(Geometry=flatten(rotax_2.Geometry), Motion=graft(Z_2))  # -> simplify(Geometry), Transform
bbox = BoundingBox(Content=move_5.Geometry, Plane=PlaneXY(0, 0, 0), UnionBox=True)  # -> Box, Box_2
tstat_3 = TreeStatistics(Tree=bbox.Box)  # -> Paths, Length, Count
area_3 = Area(Geometry=bbox.Box)  # -> Area, Centroid
X_4 = UnitX(Factor=1)
series_6 = Series(Start=0, Step=Slider(25, range=0..360), Count=tstat_3.Count)  # -> graft(Series)
line_3 = LineSDL(Start=area_3.Centroid, Direction=X_4, Length=1)
rotax_3 = RotateAxis(Geometry=move_5.Geometry, Angle=degrees(series_6), Axis=line_3)  # -> Geometry, Transform
preview = CustomPreview(Geometry=rotax_3.Geometry, Material=ColourSwatch(SwatchColor=RGB(117, 117, 117)))
