# Grasshopper definition cmplx_generativeArchitecture.gh (Grasshopper 1.0.7)
# plug-ins: Pufferfish, Human

number_slider = Slider(50, range=0..50)
# Script Title: Generative Architecture
# Created by: Michael Hoehn
# Last Modified: 220121
number_slider_2 = Slider(50, range=0..50)
dom = ConstructDomain(DomainStart=expr("x/2", number_slider), DomainEnd=expr("-x/2", number_slider))
dom_2 = ConstructDomain(DomainStart=expr("x/2", number_slider_2), DomainEnd=expr("-x/2", number_slider_2))
dom_3 = ConstructDomain(DomainStart=Slider(2, range=0..100), DomainEnd=Slider(7, range=0..100))
rectangle = Rectangle(Plane=PlaneXY(0, 0, 0), XSize=dom_2, YSize=dom, Radius=0)  # -> Rectangle, Length
number_slider_3 = Slider(46, range=0..10000)
random = Random(Range=dom_3, Number=1, Seed=number_slider_3)
crv = Curve(rectangle.Rectangle)
round = Round(Number=random)  # -> Nearest, Floor, Ceiling
area = Area(Geometry=crv)  # -> Area, Centroid
dom_4 = ConstructDomain(DomainStart=Slider(12.47, range=0..50), DomainEnd=Slider(17.03, range=0..50))
dom_5 = ConstructDomain(DomainStart=Slider(7.52, range=0..50), DomainEnd=Slider(11.72, range=0..50))
scale = Scale(Geometry=crv, Center=area.Centroid, Factor=Slider(0.399, range=0..5))  # -> Geometry, Transform
random_2 = Random(Range=dom_4, Number=round.Nearest, Seed=number_slider_3)
random_3 = Random(Range=dom_5, Number=round.Nearest, Seed=number_slider_3)

max_frame_count = Slider(5, range=1..100)
dom_6 = ConstructDomain(DomainStart="1", DomainEnd=max_frame_count)
dom_7 = ConstructDomain(DomainStart="0", DomainEnd="9999")
remap = RemapNumbers(Value=number_slider_3, Source=dom_7, Target=dom_6)  # -> Mapped, Clipped
round_2 = Round(Number=remap.Mapped)  # -> Nearest, Floor, Ceiling
high_res_view_cap = GhPythonScript(active=Toggle(False), filePath="E:\NFTs\Architecture\ArchitectureGen", frame=round_2.Floor)  # -> out, a; inputs frame: Int32
# ---------- high_res_view_cap: Python ----------
import rhinoscriptsyntax as rs

if active: 
    savedLocation = filePath + str(int(frame)).zfill(4) +".png"
    rs.Command("-ViewCaptureToFile \n\"" + savedLocation + "\"\n")
# ---------- end high_res_view_cap ----------

dom_8 = ConstructDomain(DomainStart=expr("x/2", random_2), DomainEnd=expr("-x/2", random_2))
dom_9 = ConstructDomain(DomainStart=expr("x/2", random_3), DomainEnd=expr("-x/2", random_3))
dup = DuplicateData(Data="0", Number=expr("x/2", round.Nearest), Order=True)
dup_2 = DuplicateData(Data="1", Number=expr("x/2", round.Nearest), Order=True)
pop2d = Populate2D(Region=scale.Geometry, Count=round.Nearest, Seed=number_slider_3)
merge = Merge(Data1=dup, Data2=dup_2)
rectangle_2 = Rectangle(Plane=pop2d, XSize=dom_9, YSize=dom_8, Radius=0)  # -> Rectangle, Length
area_2 = Area(Geometry=rectangle_2.Rectangle)  # -> Area, Centroid
short = ShortestList(ListA=area_2.Centroid, ListB=merge, TrimMode=2)  # -> ListA, ListB
jitter = Jitter(List=short.ListB, Jitter=1, Seed=expr("x+1", number_slider_3))  # -> Values, Indices
int = Integer(jitter.Values)
expression = Expression(x=int, Expression="If(x=0, x, 90)")
rotate = Rotate(Geometry=rectangle_2.Rectangle, Angle=degrees(expression), Plane=area_2.Centroid)  # -> Geometry, Transform
explode = Explode(Curve=rotate.Geometry, Recursive=True)  # -> simplify(Segments), Vertices
eval = EvaluateCurve(Curve=reparameterize(explode.Segments), Parameter=0.5)  # -> Point, Tangent, Angle
item = ListItem(List=explode.Segments, Index=0, Wrap=True)  # -> Item, Item1, Item2, Item3
dom_10 = ConstructDomain(DomainStart=Slider(0.951, range=0..5), DomainEnd=Slider(1.06, range=0..5))
dom_11 = ConstructDomain(DomainStart=Slider(0.748, range=0..5), DomainEnd=Slider(1.217, range=0..5))
dom_12 = ConstructDomain(DomainStart=Slider(0.975, range=0..5), DomainEnd=Slider(1.066, range=0..5))
dom_13 = ConstructDomain(DomainStart=Slider(0.299, range=0..5), DomainEnd=Slider(1.65, range=0..5))
lng = ListLength(List=rectangle_2.Rectangle)
item_2 = ListItem(List=eval.Point, Index=0, Wrap=True)  # -> Item, Item1, Item2, Item3
random_4 = Random(Range=dom_11, Number=lng, Seed=expr("x+1", number_slider_3))  # -> simplify(graft(Random))
random_5 = Random(Range=dom_12, Number=lng, Seed=expr("x+2", number_slider_3))  # -> simplify(graft(Random))
random_6 = Random(Range=dom_13, Number=lng, Seed=number_slider_3)  # -> simplify(graft(Random))
scale_2 = Scale(Geometry=item.Item, Center=item_2.Item, Factor=random_6)  # -> Geometry, Transform
random_7 = Random(Range=dom_10, Number=lng, Seed=expr("x+3", number_slider_3))  # -> simplify(graft(Random))
end = EndPoints(Curve=item.Item3)  # -> Start, End
end_2 = EndPoints(Curve=item.Item2)  # -> Start, End
end_3 = EndPoints(Curve=scale_2.Geometry)  # -> Start, End
pt = Point(end.Start)
pt_2 = Point(end_2.Start)
merge_2 = Merge(Data1=pt_2, Data2=pt, Data3=end_3.Start, Data4=end_3.End)
pline = PolyLine(Vertices=merge_2, Closed=invert(False))
explode_2 = Explode(Curve=pline, Recursive=True)  # -> simplify(Segments), Vertices
eval_2 = EvaluateCurve(Curve=reparameterize(explode_2.Segments), Parameter=0.5)  # -> Point, Tangent, Angle
item_3 = ListItem(List=explode_2.Segments, Index=0, Wrap=True)  # -> Item, Item1, Item2, Item3
item_4 = ListItem(List=eval_2.Point, Index=0, Wrap=True)  # -> Item, Item1, Item2, Item3
scale_3 = Scale(Geometry=item_3.Item1, Center=item_4.Item1, Factor=random_4)  # -> Geometry, Transform
end_4 = EndPoints(Curve=item_3.Item)  # -> Start, End
end_5 = EndPoints(Curve=item_3.Item3)  # -> Start, End
end_6 = EndPoints(Curve=scale_3.Geometry)  # -> Start, End
pt_3 = Point(end_4.Start)
pt_4 = Point(end_5.Start)
merge_3 = Merge(Data1=end_6.Start, Data2=pt_3, Data3=pt_4, Data4=end_6.End)
pline_2 = PolyLine(Vertices=merge_3, Closed=invert(False))
explode_3 = Explode(Curve=pline_2, Recursive=True)  # -> simplify(Segments), Vertices
eval_3 = EvaluateCurve(Curve=reparameterize(explode_3.Segments), Parameter=0.5)  # -> Point, Tangent, Angle
item_5 = ListItem(List=explode_3.Segments, Index=0, Wrap=True)  # -> Item, Item1, Item2, Item3
item_6 = ListItem(List=eval_3.Point, Index=0, Wrap=True)  # -> Item, Item1, Item2, Item3
scale_4 = Scale(Geometry=item_5.Item1, Center=item_6.Item1, Factor=random_4)  # -> Geometry, Transform
end_7 = EndPoints(Curve=item_5.Item)  # -> Start, End
end_8 = EndPoints(Curve=item_5.Item3)  # -> Start, End
end_9 = EndPoints(Curve=scale_4.Geometry)  # -> Start, End
pt_5 = Point(end_7.Start)
pt_6 = Point(end_8.Start)
merge_4 = Merge(Data1=end_9.End, Data3=pt_6, Data4=pt_5, Data5=end_9.Start)
pline_3 = PolyLine(Vertices=merge_4, Closed=invert(False))
explode_4 = Explode(Curve=pline_3, Recursive=True)  # -> simplify(Segments), Vertices
eval_4 = EvaluateCurve(Curve=reparameterize(explode_4.Segments), Parameter=0.5)  # -> Point, Tangent, Angle
item_7 = ListItem(List=explode_4.Segments, Index=0, Wrap=True)  # -> Item, Item1, Item2, Item3
item_8 = ListItem(List=eval_4.Point, Index=0, Wrap=True)  # -> Item, Item1, Item2, Item3
scale_5 = Scale(Geometry=item_7.Item2, Center=item_8.Item2, Factor=random_6)  # -> Geometry, Transform
end_10 = EndPoints(Curve=item_7.Item)  # -> Start, End
end_11 = EndPoints(Curve=item_7.Item1)  # -> Start, End
end_12 = EndPoints(Curve=scale_5.Geometry)  # -> Start, End
pt_7 = Point(end_11.Start)
pt_8 = Point(end_10.Start)
merge_5 = Merge(Data1=end_12.Start, Data2=end_12.End, Data3=pt_8, Data4=pt_7)
pline_4 = PolyLine(Vertices=merge_5, Closed=invert(False))  # -> flatten(Polyline)
runion = RegionUnion(Curves=pline_4)
area_3 = Area(Geometry=runion)  # -> Area, Centroid
bnd = Bounds(Numbers=area_3.Area)
dedomain = DeconstructDomain(Domain=bnd)  # -> Start, End
multiplication = Multiplication(A=dedomain.End, B=Slider(0.1, range=0..1))
dom_14 = ConstructDomain(DomainStart=Slider(0, range=0..20), DomainEnd=Slider(10.84, range=0..20))
smaller = SmallerThan(FirstNumber=area_3.Area, SecondNumber=multiplication)  # -> SmallerThan, OrEqualTo
cull = CullPattern(List=runion, CullPattern=invert(smaller.SmallerThan))
lng_2 = ListLength(List=cull)
random_8 = Random(Range=dom_14, Number=lng_2, Seed=number_slider_3)
Z = UnitZ(Factor=random_8)
extr = Extrude(Base=cull, Direction=Z)
srf = Surface(cull)
cap = CapHoles(Brep=extr)
debrep = DeconstructBrep(Brep=extr)  # -> flatten(Faces), Edges, Vertices
dom_15 = ConstructDomain(DomainStart=Slider(0.92, range=0..20), DomainEnd=Slider(5.16, range=0..20))
lng_3 = ListLength(List=debrep.Faces)
dom_16 = ConstructDomain(DomainStart=Slider(0.22, range=0..20), DomainEnd=Slider(0.76, range=0..20))
lng_4 = ListLength(List=debrep.Faces)
preview = CustomPreview(Geometry=srf, Material=ColourSwatch(SwatchColor=RGB(0, 0, 0)))
area_4 = Area(Geometry=debrep.Faces)  # -> Area, Centroid
item_9 = ListItem(List=debrep.Vertices, Index=0, Wrap=True)
random_9 = Random(Range=dom_15, Number=lng_3, Seed=number_slider_3)
random_10 = Random(Range=dom_16, Number=lng_4, Seed=number_slider_3)
number_slider_4 = Slider(-34.35, range=-100..100)
wires = BrepWireframe(Brep=srf, Density=Slider(20, range=0..100))
scale_nu = ScaleNU(Geometry=debrep.Faces, Plane=item_9, ScaleX=1, ScaleY=1, ScaleZ=random_9)  # -> Geometry, Transform
Z_2 = UnitZ(Factor=number_slider_4)
previewlw = CustomPreviewLineweights(Geometry=wires, Shader=ColourSwatch(SwatchColor=RGB(255, 255, 255)), Absolute=False)
move = Move(Geometry=srf, Motion=Z_2)  # -> Geometry, Transform
preview_2 = CustomPreview(Geometry=move.Geometry, Material=ColourSwatch(SwatchColor=RGB(0, 0, 0)))
debrep_2 = DeconstructBrep(Brep=move.Geometry)  # -> Faces, Edges, Vertices
offsrf = OffsetSurface(Surface=scale_nu.Geometry, Distance=random_10, BothSides=0, CreateSolid=True)  # -> flatten(Offset)
Z_3 = UnitZ(Factor=1)
abs = Absolute(Value=number_slider_4)
debrep_3 = DeconstructBrep(Brep=offsrf)  # -> Faces, Edges, Vertices
line = LineSDL(Start=debrep_2.Vertices, Direction=Z_3, Length=abs)
area_5 = Area(Geometry=debrep_3.Faces)  # -> Area, Centroid
panel = Panel("""2
3
4
5""")
previewlw_2 = CustomPreviewLineweights(Geometry=line, Shader=ColourSwatch(SwatchColor=RGB(255, 255, 255)), Absolute=False)
pdecon = Deconstruct(Point=area_5.Centroid)  # -> XComponent, YComponent, ZComponent
sort = SortList(Keys=pdecon.ZComponent, ValuesA=debrep_3.Faces)  # -> Keys, ValuesA
dispdexs = DispatchIndices(List=debrep_3.Faces, Indices=panel)  # -> AtI, NotI
item_10 = ListItem(List=sort.ValuesA, Index=0, Wrap=True)
move_2 = Move(Geometry=item_10, Motion=Z_2)  # -> Geometry, Transform
preview_3 = CustomPreview(Geometry=dispdexs.AtI, Material=ColourSwatch(SwatchColor=RGB(0, 0, 0)))
preview_4 = CustomPreview(Geometry=dispdexs.NotI, Material=ColourSwatch(SwatchColor=RGB(255, 255, 255)))
wires_2 = BrepWireframe(Brep=dispdexs.NotI, Density=Slider(3.542, range=0..10))
wires_3 = BrepWireframe(Brep=move_2.Geometry, Density=-1)
preview_5 = CustomPreview(Geometry=move_2.Geometry, Material=ColourSwatch(SwatchColor=RGB(255, 255, 255)))
previewlw_3 = CustomPreviewLineweights(Geometry=wires_2, Shader=ColourSwatch(SwatchColor=RGB(0, 0, 0)), Absolute=False)
previewlw_4 = CustomPreviewLineweights(Geometry=wires_3, Shader=ColourSwatch(SwatchColor=RGB(0, 0, 0)), Absolute=False)
