# Grasshopper definition cmplx_LookingUp.gh (Grasshopper 1.0.7)
# plug-ins: Pufferfish, Human, BH.UI.Grasshopper

getinfo = GetInfo(Component="{ .GetInfo")
# <Script name>
project_number = Panel("")
setprojectid = SetProjectID(ProjectID=project_number, Component="{ .SetProjectID")
bhom_version_used_to_create = Panel("5.1")
bhom_version_currently_installed = Panel(getinfo)
number_slider = Slider(214, range=0..1000)
number_slider_2 = Slider(43, range=0..100)
dom = ConstructDomain(DomainStart=expr("x/2", number_slider), DomainEnd=expr("-x/2", number_slider))
dom_2 = ConstructDomain(DomainStart=Slider(1.105, range=0..10), DomainEnd=Slider(10, range=0..10))
number_slider_3 = Slider(3278, range=0..10000)
number_slider_4 = Slider(0, range=0..100)
rectangle = Rectangle(Plane=PlaneXY(0, 0, 0), XSize=dom, YSize=dom, Radius=0)  # -> Rectangle, Length
random = Random(Range=dom_2, Number=number_slider_2, Seed=number_slider_3)
crv = Curve(rectangle.Rectangle)
dom_3 = ConstructDomain(DomainStart=Slider(0.646, range=0..100), DomainEnd=Slider(5.458, range=0..100))
dom_4 = ConstructDomain(DomainStart=expr("x/2", random), DomainEnd=expr("-x/2", random))
pop2d = Populate2D(Region=crv, Count=number_slider_2, Seed=number_slider_3)
dispdexs = DispatchIndices(List=pop2d, Indices=number_slider_4)  # -> AtI, NotI
pt = Point(dispdexs.AtI)
random_2 = Random(Range=dom_3, Number=number_slider_2, Seed=number_slider_3)
rectangle_2 = Rectangle(Plane=pop2d, XSize=dom_4, YSize=dom_4, Radius=0)  # -> Rectangle, Length
dispdexs_2 = DispatchIndices(List=rectangle_2.Rectangle, Indices=number_slider_4)  # -> AtI, NotI
cir = Circle(Plane=pop2d, Radius=random_2)
dom_5 = ConstructDomain(DomainStart=Slider(0, range=0..100), DomainEnd=Slider(32, range=0..100))
merge = Merge(Data1=dispdexs_2.NotI, Data2=crv)  # -> flatten(Result)
random_3 = Random(Range=dom_5, Number=number_slider_2, Seed=number_slider_3)
srf = Surface(rectangle_2.Rectangle)
round = Round(Number=random_3)  # -> Nearest, Floor, Ceiling
Z = UnitZ(Factor=1)
ivist = IsoVist(Plane=dispdexs.AtI, Count=Slider(1000, range=0..1000), Radius=Slider(230, range=0..1000), Obstacles=merge)  # -> simplify(Points), Distance, Index
divide = DivideCurve(Curve=rectangle_2.Rectangle, Count=round.Floor, Kinks=False)  # -> simplify(Points), Tangents, Parameters
move = Move(Geometry=srf, Motion=Z)  # -> Geometry, Transform
flip = FlipMatrix(Data=divide.Points)
preview = CustomPreview(Geometry=move.Geometry, Material=ColourSwatch(SwatchColor=RGB(0, 0, 0)))  # disabled
crossref = CrossReference(ListA=flip, ListB=divide.Points, CrossMode=1)  # -> ListA, ListB
intcrv = Interpolate(Vertices=ivist.Points, Degree=3, Periodic=invert(False), KnotStyle=Slider(2, range=0..2))  # -> Curve, Length, Domain
ln = Line(StartPoint=crossref.ListA, EndPoint=crossref.ListB)
srf_2 = Surface(crv)
srf_3 = Surface(intcrv.Curve)
Z_2 = UnitZ(Factor=1)
move_2 = Move(Geometry=srf_3, Motion=Z_2)  # -> Geometry, Transform
previewlw = CustomPreviewLineweights(Geometry=ln, Shader=ColourSwatch(SwatchColor=RGB(219, 219, 219)), Absolute=False)
preview_2 = CustomPreview(Geometry=srf_2, Material=ColourSwatch(SwatchColor=RGB(0, 0, 0)))
preview_3 = CustomPreview(Geometry=move_2.Geometry, Material=ColourSwatch(SwatchColor=RGB(255, 255, 255)))
