# Grasshopper definition cmplx_nonlinearRegression-surfacePlot.gh (Grasshopper 1.0.7)
# plug-ins: Human, LunchBoxML

n_sample_points = Slider(34, range=0..50)
random = Random(Range="0 to 5", Number=n_sample_points, Seed="10")
random_2 = Random(Range="0 to 30", Number=n_sample_points, Seed="8")
random_3 = Random(Range="0 to 30", Number=n_sample_points, Seed="5")
pt = ConstructPoint(XCoordinate=random_3, YCoordinate=random_2, ZCoordinate=random)
entwine = Entwine(Branch00=random_3, Branch01=random_2, FlattenInputs=True)
flip = FlipMatrix(Data=entwine)
dots = DotDisplay(Point=pt, Colour=ColourSwatch(SwatchColor=RGB(255, 0, 115)), Size=Slider(0.3, range=0..1))

# ---- group: Test Points
number_slider = Slider(50, range=0..50)
range = Range(Domain="0 to 30", Steps=number_slider)
range_2 = Range(Domain="0 to 30", Steps=number_slider)
crossref = CrossReference(ListA=range_2, ListB=range, CrossMode=1)  # -> ListA, ListB
entwine_2 = Entwine(Branch00=crossref.ListA, Branch01=crossref.ListB, FlattenInputs=True)
flip_2 = FlipMatrix(Data=entwine_2)

# ---- group: Cycle iterations
sigma = Slider(5.272, range=0.75..20)

# ---- group: Non-linear regression
nonlinereg = NonlinearRegression(
    TestData=flip_2,
    Inputs=flip,
    Output=random,
    Degree=sigma,
    Complexity=Slider(100, range=0..100),
    RandomSeed=Slider(9999, range=0..10000))  # -> Result, Score, Error

# ----
pt_2 = ConstructPoint(XCoordinate=crossref.ListA, YCoordinate=crossref.ListB, ZCoordinate=flatten(nonlinereg.Result))
preview = CustomPreview(Geometry=pt_2, Shader=ColourSwatch(SwatchColor=RGB(255, 255, 255)))

srfgrid = SurfaceFromPoints(Points=pt_2, UCount=expr("x+1", number_slider), Interpolate=False)
pt_3 = ConstructPoint(XCoordinate=0, YCoordinate=0, ZCoordinate=0)
Y = UnitY(Factor=1)
contour = Contour(Shape=srfgrid, Point=pt_3, Direction=Y, Distance=Slider(0.2, range=0.1..10))
previewlw = CustomPreviewLineweights(
    Geometry=contour,
    Shader=ColourSwatch(SwatchColor=RGB(255, 255, 255)),
    Thickness=Slider(2.457, range=0..10),
    Absolute=False)
