# Grasshopper definition cmplx_perspective-many to many.gh (Grasshopper 1.0.7)
# plug-ins: Human

range = Range(Domain=Domain(0, 1), Steps=Slider(50, range=0..100))
panel = Panel(range)
number_slider = Slider(881, range=0..10000)
number_slider_2 = Slider(1, range=0..1)
number_slider_3 = Slider(670, range=0..1000)

# ----
# Script Title: Custom High-Res Recorder
# Created by: Michael Hoehn
# Last Modified: 220121
max_frame_count = Slider(50, range=1..100)
domain_max = Slider(1, range=1..100)
dom = ConstructDomain(DomainStart="1", DomainEnd=max_frame_count)
dom_2 = ConstructDomain(DomainStart="0", DomainEnd=domain_max)
remap = RemapNumbers(Value=number_slider_2, Source=dom_2, Target=dom)  # -> Mapped, Clipped
round = Round(Number=remap.Mapped)  # -> Nearest, Floor, Ceiling
high_res_view_cap = GhPythonScript(active=Toggle(False), filePath="E:\NFTs\ManyPerspective\Img_", frame=round.Floor)  # -> out, a; inputs frame: Int32
# ---------- high_res_view_cap: Python ----------
import rhinoscriptsyntax as rs

if active: 
    savedLocation = filePath + str(int(frame)).zfill(4) +".png"
    rs.Command("-ViewCaptureToFile \n\"" + savedLocation + "\"\n")
# ---------- end high_res_view_cap ----------

number_slider_4 = Slider(20, range=0..100)

dom_3 = ConstructDomain(DomainStart=Slider(76, range=0..500), DomainEnd=Slider(227, range=0..500))
dom_4 = ConstructDomain(DomainStart=Slider(28, range=0..500), DomainEnd=Slider(226, range=0..500))
random = Random(Range=dom_4, Number=number_slider_4, Seed=number_slider)
random_2 = Random(Range=dom_3, Number=number_slider_4, Seed=number_slider)
dom_5 = ConstructDomain(DomainStart=expr("x/2", random), DomainEnd=expr("-x/2", random))
dom_6 = ConstructDomain(DomainStart=expr("x/2", random_2), DomainEnd=expr("-x/2", random_2))

dom_7 = ConstructDomain(DomainStart=Slider(2, range=0..500), DomainEnd=Slider(47, range=0..500))
dom_8 = ConstructDomain(DomainStart=Slider(2, range=0..500), DomainEnd=Slider(40, range=0..500))
random_3 = Random(Range=dom_8, Number=number_slider_4, Seed=expr("x+2", number_slider))
random_4 = Random(Range=dom_7, Number=number_slider_4, Seed=expr("x+1", number_slider))
dom_9 = ConstructDomain(DomainStart=expr("x/2", random_3), DomainEnd=expr("-x/2", random_3))
dom_10 = ConstructDomain(DomainStart=expr("x/2", random_4), DomainEnd=expr("-x/2", random_4))

dom_11 = ConstructDomain(DomainStart=expr("x/2", number_slider_3), DomainEnd=expr("-x/2", number_slider_3))
rectangle = Rectangle(Plane=PlaneXY(0, 0, 0), XSize=dom_11, YSize=dom_11, Radius=0)  # -> Rectangle, Length
frame = Curve(rectangle.Rectangle)
random_5 = Random(Range=Domain(0, 9999), Number=number_slider_4, Seed=2)  # -> simplify(Random)
pop2d = Populate2D(Region=frame, Count=number_slider_4, Seed=number_slider)
rectangle_2 = Rectangle(Plane=pop2d, XSize=dom_6, YSize=dom_5, Radius=0)  # -> Rectangle, Length
pop2d_2 = Populate2D(Region=rectangle_2.Rectangle, Count=Slider(4, range=0..100), Seed=random_5)
dom_12 = ConstructDomain(DomainStart=0, DomainEnd=Slider(1, range=0..1))
crv = Curve(rectangle_2.Rectangle)
intcrv = Interpolate(Vertices=pop2d_2, Degree=3, Periodic=False, KnotStyle=1)  # -> flatten(Curve), Length, Domain
range_2 = Range(Domain=dom_12, Steps=Slider(75, range=0..500))
crv_2 = Curve(intcrv.Curve)
eval = EvaluateCurve(Curve=reparameterize(crv_2), Parameter=number_slider_2)  # -> Point, Tangent, Angle
rectangle_3 = Rectangle(Plane=eval.Point, XSize=dom_10, YSize=dom_9, Radius=0)  # -> Rectangle, Length
tweencrv = TweenCurve(CurveA=rectangle_3.Rectangle, CurveB=crv, Factor=graft(range_2), BlendType=0)
flip = FlipMatrix(Data=tweencrv)  # -> simplify(Data)
tstat = TreeStatistics(Tree=flip)  # -> Paths, Length, Count
dom_13 = ConstructDomain(DomainStart=Slider(1, range=1..255), DomainEnd=Slider(255, range=1..255))
dom_14 = ConstructDomain(DomainStart=Slider(1, range=1..255), DomainEnd=Slider(255, range=1..255))
dom_15 = ConstructDomain(DomainStart=Slider(54, range=1..255), DomainEnd=Slider(215, range=1..255))
random_6 = Random(Range=dom_14, Number=tstat.Count, Seed=expr("x+1", number_slider))
random_7 = Random(Range=dom_15, Number=tstat.Count, Seed=expr("x+1", number_slider))
random_8 = Random(Range=dom_13, Number=tstat.Count, Seed=number_slider)
round_2 = Round(Number=random_6)  # -> Nearest, Floor, Ceiling
round_3 = Round(Number=random_8)  # -> Nearest, Floor, Ceiling
round_4 = Round(Number=random_7)  # -> Nearest, Floor, Ceiling
dom_16 = ConstructDomain(DomainStart=Slider(0, range=0..25), DomainEnd=Slider(3.395, range=0..25))
rgb = ColourRGB(Alpha=255, Red=round_3.Nearest, Green=round_2.Nearest, Blue=round_4.Nearest)  # -> simplify(graft(Colour))
srf = Surface(rectangle_3.Rectangle)
range_3 = Range(Domain=dom_16, Steps=tstat.Count)  # -> simplify(graft(Range))
previewlw = CustomPreviewLineweights(Geometry=simplify(graft(crv)), Shader=rgb, Thickness=Slider(5.289, range=0..10), Absolute=False)
preview = CustomPreview(Geometry=srf, Material=flatten(rgb))
previewlw_2 = CustomPreviewLineweights(Geometry=flip, Shader=rgb, Thickness=range_3, Absolute=False)
