# Grasshopper definition cmplx_perspective2D.gh (Grasshopper 1.0.7)
# plug-ins: Human

range = Range(Domain=Domain(0, 1), Steps=Slider(50, range=0..100))
panel = Panel(range)
number_slider = Slider(881, range=0..10000)
snap = Button()
item = ListItem(List=panel, Index=Slider(0, range=0..100), Wrap=True)

# ---- group: Many to One
number_slider_2 = Slider(169, range=0..10000)
number_slider_3 = Slider(500, range=0..500)
number_slider_4 = Slider(86, range=0..100)
dom = ConstructDomain(DomainStart=expr("x/2", number_slider_3), DomainEnd=expr("-x/2", number_slider_3))
dom_2 = ConstructDomain(DomainStart=Slider(49, range=0..500), DomainEnd=Slider(101, range=0..500))
dom_3 = ConstructDomain(DomainStart=Slider(20, range=0..500), DomainEnd=Slider(127, range=0..500))
rectangle = Rectangle(Plane=PlaneXY(0, 0, 0), XSize=dom, YSize=dom, Radius=0)  # -> Rectangle, Length
random = Random(Range=dom_3, Number=number_slider_4, Seed=number_slider_2)
random_2 = Random(Range=dom_2, Number=number_slider_4, Seed=number_slider_2)
crv = Curve(rectangle.Rectangle)
dom_4 = ConstructDomain(DomainStart=0, DomainEnd=Slider(1, range=0..1))
pop2d = Populate2D(Region=crv, Count=number_slider_4, Seed=number_slider_2)
range_2 = Range(Domain=dom_4, Steps=Slider(91, range=0..500))
rectangle_2 = Rectangle(Plane=pop2d, XSize=random_2, YSize=random, Radius=0)  # -> Rectangle, Length
series = Series(Start=0, Step=1, Count=10)
crv_2 = Curve(rectangle_2.Rectangle)
lng = ListLength(List=crv_2)
tweencrv = TweenCurve(CurveA=crv_2, CurveB=graft(crv), Factor=graft(range_2), BlendType=0)
flip = FlipMatrix(Data=tweencrv)  # -> simplify(Data)
tstat = TreeStatistics(Tree=flip)  # -> Paths, Length, Count
dom_5 = ConstructDomain(DomainStart=Slider(1, range=1..255), DomainEnd=Slider(255, range=1..255))
dom_6 = ConstructDomain(DomainStart=Slider(1, range=1..255), DomainEnd=Slider(255, range=1..255))
dom_7 = ConstructDomain(DomainStart=Slider(54, range=1..255), DomainEnd=Slider(215, range=1..255))
random_3 = Random(Range=dom_6, Number=tstat.Count, Seed=expr("x+1", number_slider_2))
random_4 = Random(Range=dom_7, Number=tstat.Count, Seed=expr("x+1", number_slider_2))
random_5 = Random(Range=dom_5, Number=tstat.Count, Seed=number_slider_2)
round = Round(Number=random_3)  # -> Nearest, Floor, Ceiling
round_2 = Round(Number=random_5)  # -> Nearest, Floor, Ceiling
round_3 = Round(Number=random_4)  # -> Nearest, Floor, Ceiling
rgb = ColourRGB(Alpha=255, Red=round_2.Nearest, Green=round.Nearest, Blue=round_3.Nearest)  # -> simplify(graft(Colour))
dom_8 = ConstructDomain(DomainStart=Slider(0, range=0..25), DomainEnd=Slider(6.53, range=0..25))
range_3 = Range(Domain=dom_8, Steps=tstat.Count)  # -> simplify(graft(Range))
previewlw = CustomPreviewLineweights(Geometry=simplify(graft(crv_2)), Shader=rgb, Thickness=Slider(10, range=0..10), Absolute=False)
previewlw_2 = CustomPreviewLineweights(Geometry=flip, Shader=rgb, Thickness=range_3, Absolute=False)

# ---- group: One to One
# Script Title: Perspective
# Created by: Michael Hoehn
# Last Modified: 220121
number_slider_5 = Slider(5, range=0..100)
number_slider_6 = Slider(124, range=0..500)
number_slider_7 = Slider(1, range=0..1)
dom_9 = ConstructDomain(DomainStart=expr("x/2", number_slider_6), DomainEnd=expr("-x/2", number_slider_6))
remap = RemapNumbers(Value=number_slider_7, Source=Domain(0, 1), Target=dom_9)  # -> Mapped, Clipped
number_slider_8 = Slider(250, range=0..500)
number_slider_9 = Slider(500, range=0..500)
dom_10 = ConstructDomain(DomainStart=expr("x/2", number_slider_8), DomainEnd=expr("-x/2", number_slider_8))
dom_11 = ConstructDomain(DomainStart=expr("x/2", number_slider_9), DomainEnd=expr("-x/2", number_slider_9))
rectangle_3 = Rectangle(Plane=PlaneXY(0, 0, 0), XSize=dom_11, YSize=dom_10, Radius=0)  # -> Rectangle, Length
pop2d_2 = Populate2D(Region=rectangle_3.Rectangle, Count=number_slider_5, Seed=Slider(10000, range=0..10000))
intcrv = Interpolate(Vertices=pop2d_2, Degree=3, Periodic=False, KnotStyle=1)  # -> Curve, Length, Domain
crv_3 = Curve(intcrv.Curve)
eval = EvaluateCurve(Curve=reparameterize(crv_3), Parameter=number_slider_7)  # -> Point, Tangent, Angle
rectangle_4 = Rectangle(Plane=eval.Point, XSize=remap.Mapped, YSize=remap.Mapped, Radius=0)  # -> Rectangle, Length
dom_12 = ConstructDomain(DomainStart=0, DomainEnd=Slider(1, range=0..1))
crv_4 = Curve(rectangle_4.Rectangle)
crv_5 = Curve(rectangle_3.Rectangle)
range_4 = Range(Domain=dom_12, Steps=Slider(91, range=0..500))
explode = Explode(Curve=crv_4, Recursive=True)  # -> Segments, Vertices
tweencrv_2 = TweenCurve(CurveA=crv_4, CurveB=crv_5, Factor=range_4, BlendType=0)
len = Length(Curve=tweencrv_2)
partition = PartitionList(List=explode.Segments, Size=2)  # -> simplify(Chunks)
dom_13 = ConstructDomain(DomainStart=0, DomainEnd=Slider(10, range=0..10))
dom_14 = ConstructDomain(DomainStart=0, DomainEnd=Slider(20, range=0..100))
bnd = Bounds(Numbers=len)
bang = ExplodeTree(Data=partition)  # -> Branch0, Branch1
remap_2 = RemapNumbers(Value=len, Source=bnd, Target=dom_13)  # -> Mapped, Clipped
shift = ShiftList(List=bang.Branch1, Shift=1, Wrap=True)
divide = DivideCurve(Curve=bang.Branch0, Count=dom_14, Kinks=False)  # -> Points, Tangents, Parameters
divide_2 = DivideCurve(Curve=shift, Count=dom_14, Kinks=False)  # -> reverse(Points), Tangents, Parameters
ln = Line(StartPoint=divide.Points, EndPoint=divide_2.Points)
area = Area(Geometry=crv_4)  # -> Area, Centroid
previewlw_3 = CustomPreviewLineweights(Geometry=tweencrv_2, Shader=ColourSwatch(SwatchColor=RGB(0, 0, 0)), Thickness=remap_2.Mapped, Absolute=False)
rotate = Rotate(Geometry=ln, Angle=1.570796327, Plane=area.Centroid)  # -> flatten(Geometry), Transform
previewlw_4 = CustomPreviewLineweights(
    Geometry=flatten([rotate.Geometry, ln]),
    Shader=ColourSwatch(SwatchColor=RGB(0, 0, 0)),
    Thickness=Slider(0, range=0..10),
    Absolute=False)

# ----
number_slider_10 = Slider(0, range=0..1)
number_slider_11 = Slider(670, range=0..1000)
number_slider_12 = Slider(20, range=0..100)

dom_15 = ConstructDomain(DomainStart=Slider(76, range=0..500), DomainEnd=Slider(227, range=0..500))
dom_16 = ConstructDomain(DomainStart=Slider(28, range=0..500), DomainEnd=Slider(226, range=0..500))
random_6 = Random(Range=dom_16, Number=number_slider_12, Seed=number_slider)
random_7 = Random(Range=dom_15, Number=number_slider_12, Seed=number_slider)
dom_17 = ConstructDomain(DomainStart=expr("x/2", random_6), DomainEnd=expr("-x/2", random_6))
dom_18 = ConstructDomain(DomainStart=expr("x/2", random_7), DomainEnd=expr("-x/2", random_7))

dom_19 = ConstructDomain(DomainStart=Slider(2, range=0..500), DomainEnd=Slider(47, range=0..500))
dom_20 = ConstructDomain(DomainStart=Slider(2, range=0..500), DomainEnd=Slider(40, range=0..500))
random_8 = Random(Range=dom_20, Number=number_slider_12, Seed=expr("x+2", number_slider))
random_9 = Random(Range=dom_19, Number=number_slider_12, Seed=expr("x+1", number_slider))
dom_21 = ConstructDomain(DomainStart=expr("x/2", random_8), DomainEnd=expr("-x/2", random_8))
dom_22 = ConstructDomain(DomainStart=expr("x/2", random_9), DomainEnd=expr("-x/2", random_9))

dom_23 = ConstructDomain(DomainStart=expr("x/2", number_slider_11), DomainEnd=expr("-x/2", number_slider_11))
rectangle_5 = Rectangle(Plane=PlaneXY(0, 0, 0), XSize=dom_23, YSize=dom_23, Radius=0)  # -> Rectangle, Length
frame = Curve(rectangle_5.Rectangle)
random_10 = Random(Range=Domain(0, 9999), Number=number_slider_12, Seed=2)  # -> simplify(Random)

# ----
# Script Title: Custom High-Res Recorder
# Created by: Michael Hoehn
# Last Modified: 220121
max_frame_count = Slider(50, range=1..100)
domain_max = Slider(1, range=1..100)
dom_24 = ConstructDomain(DomainStart="1", DomainEnd=max_frame_count)
dom_25 = ConstructDomain(DomainStart="0", DomainEnd=domain_max)
remap_3 = RemapNumbers(Value=item, Source=dom_25, Target=dom_24)  # -> Mapped, Clipped
toggle = BooleanToggle(False)
round_4 = Round(Number=remap_3.Mapped)  # -> Nearest, Floor, Ceiling
high_res_view_cap = GhPythonScript(active=snap, filePath="E:\NFTs\ManyPerspective\Img_", frame=round_4.Floor)  # -> out, a; inputs frame: Int32
# ---------- high_res_view_cap: Python ----------
import rhinoscriptsyntax as rs

if active: 
    savedLocation = filePath + str(int(frame)).zfill(4) +".png"
    rs.Command("-ViewCaptureToFile \n\"" + savedLocation + "\"\n")
# ---------- end high_res_view_cap ----------

pop2d_3 = Populate2D(Region=frame, Count=number_slider_12, Seed=number_slider)
rectangle_6 = Rectangle(Plane=pop2d_3, XSize=dom_18, YSize=dom_17, Radius=0)  # -> Rectangle, Length
pop2d_4 = Populate2D(Region=rectangle_6.Rectangle, Count=Slider(4, range=0..100), Seed=random_10)
dom_26 = ConstructDomain(DomainStart=0, DomainEnd=Slider(1, range=0..1))
crv_6 = Curve(rectangle_6.Rectangle)
intcrv_2 = Interpolate(Vertices=pop2d_4, Degree=3, Periodic=False, KnotStyle=1)  # -> flatten(Curve), Length, Domain
range_5 = Range(Domain=dom_26, Steps=Slider(75, range=0..500))
crv_7 = Curve(intcrv_2.Curve)
eval_2 = EvaluateCurve(Curve=reparameterize(crv_7), Parameter=item)  # -> Point, Tangent, Angle
rectangle_7 = Rectangle(Plane=eval_2.Point, XSize=dom_22, YSize=dom_21, Radius=0)  # -> Rectangle, Length
tweencrv_3 = TweenCurve(CurveA=rectangle_7.Rectangle, CurveB=crv_6, Factor=graft(range_5), BlendType=0)
flip_2 = FlipMatrix(Data=tweencrv_3)  # -> simplify(Data)
tstat_2 = TreeStatistics(Tree=flip_2)  # -> Paths, Length, Count
dom_27 = ConstructDomain(DomainStart=Slider(1, range=1..255), DomainEnd=Slider(255, range=1..255))
dom_28 = ConstructDomain(DomainStart=Slider(1, range=1..255), DomainEnd=Slider(255, range=1..255))
dom_29 = ConstructDomain(DomainStart=Slider(54, range=1..255), DomainEnd=Slider(215, range=1..255))
random_11 = Random(Range=dom_28, Number=tstat_2.Count, Seed=expr("x+1", number_slider))
random_12 = Random(Range=dom_29, Number=tstat_2.Count, Seed=expr("x+1", number_slider))
random_13 = Random(Range=dom_27, Number=tstat_2.Count, Seed=number_slider)
round_5 = Round(Number=random_11)  # -> Nearest, Floor, Ceiling
round_6 = Round(Number=random_13)  # -> Nearest, Floor, Ceiling
round_7 = Round(Number=random_12)  # -> Nearest, Floor, Ceiling
dom_30 = ConstructDomain(DomainStart=Slider(0, range=0..25), DomainEnd=Slider(3.252, range=0..25))
rgb_2 = ColourRGB(Alpha=255, Red=round_6.Nearest, Green=round_5.Nearest, Blue=round_7.Nearest)  # -> simplify(graft(Colour))
srf = Surface(rectangle_7.Rectangle)
range_6 = Range(Domain=dom_30, Steps=tstat_2.Count)  # -> simplify(graft(Range))
previewlw_5 = CustomPreviewLineweights(Geometry=simplify(graft(crv_6)), Shader=rgb_2, Thickness=Slider(3.736, range=0..10), Absolute=False)
preview = CustomPreview(Geometry=srf, Material=flatten(rgb_2))
previewlw_6 = CustomPreviewLineweights(Geometry=flip_2, Shader=rgb_2, Thickness=range_6, Absolute=False)
