# Grasshopper definition cmplx_random.gh (Grasshopper 1.0.7)
# plug-ins: Human, LunchBox

genes = GenePool(Decimals=2, Maximum=36, Minimum=0, Value=[8.64, 16.1])
genes_2 = GenePool(Decimals=2, Maximum=36, Minimum=0, Value=[4.08, 9.89])
genes_3 = GenePool(Decimals=2, Maximum=255, Minimum=0, Value=[155.66, 70.15, 7.41])
genes_4 = GenePool(Decimals=2, Maximum=255, Minimum=0, Value=[231.19, 188.6, 177.04])
number_slider = Slider(3, range=3..5)
number_slider_2 = Slider(27, range=3..50)
number_slider_3 = Slider(9307, range=0..10000)
number_slider_4 = Slider(0.11, range=-1..1)
number_slider_5 = Slider(0.07, range=-1..1)
number_slider_6 = Slider(8.93, range=5..10)
number_slider_7 = Slider(0, range=0..360)
number_slider_8 = Slider(13.28, range=10..20)
number_slider_9 = Slider(1.99, range=0.5..2)
number_slider_10 = Slider(5, range=3..8)
number_slider_11 = Slider(4.168, range=0.5..5)
number_slider_12 = Slider(2.858, range=0.5..5)
number_slider_13 = Slider(13, range=3..30)
number_slider_14 = Slider(157, range=10..255)
number_slider_15 = Slider(19, range=10..255)
merge = Merge(
    Data1=number_slider,
    Data2=number_slider_2,
    Data3=number_slider_3,
    Data4=number_slider_4,
    Data5=number_slider_5,
    Data6=genes,
    Data7=number_slider_6,
    Data8=number_slider_7,
    Data9=number_slider_8,
    Data10=genes_2,
    Data11=number_slider_9,
    Data12=number_slider_10,
    Data13=number_slider_11,
    Data14=number_slider_12,
    Data15=number_slider_13,
    Data16=genes_3,
    Data17=genes_4,
    Data18=number_slider_14,
    Data19=number_slider_15)  # -> flatten(Result)
number_slider_16 = Slider(36, range=0..2400)
polygon = Polygon(Plane=PlaneXY(0, 0, 0), Radius=3, Segments=number_slider, FilletRadius=0)  # -> Polygon, Length
item = ListItem(List=genes_2, Index=0, Wrap=True)  # -> Item, Item1
ma = MassAddition(Input=merge)  # -> Result, PartialResults
cir = Circle(Plane=PlaneXY(0, 0, 0), Radius=number_slider_8)
crv = Curve(polygon.Polygon)
vec = VectorXYZ(XComponent=item.Item, YComponent=item.Item1, ZComponent=0)  # -> Vector, Length
crv_2 = Curve(cir)
rectangle = Rectangle(Plane=PlaneXY(0, 0, 0), XSize=number_slider_16, YSize=number_slider_16, Radius=0)  # -> Rectangle, Length
division = Division(A=ma.Result, B=Slider(51.49, range=0..100))
cluster = Cluster(G=crv, N=number_slider_2, S=number_slider_3, A=number_slider_4, B=number_slider_5)
crv_3 = Curve(rectangle.Rectangle)
move = Move(Geometry=crv_2, Motion=vec.Vector)  # -> Geometry, Transform
galapagos = Galapagos(
    fitness=division,
    gene=[number_slider, number_slider_2, number_slider_3, number_slider_4, number_slider_5, genes, number_slider_6, number_slider_7, number_slider_8, genes_2, number_slider_9, number_slider_10, number_slider_11, number_slider_12, number_slider_13, genes_3, genes_4, number_slider_14, number_slider_15])
previewlw = CustomPreviewLineweights(Geometry=crv_3, Shader=ColourSwatch(SwatchColor=RGB(207, 207, 207)), Absolute=False)
cluster_2 = Cluster(G=move.Geometry, N=number_slider_2, S=number_slider_3, A=number_slider_4, B=number_slider_5)
filter = StreamFilter(Gate=0)
srf = Surface(cluster_2)
item_2 = ListItem(List=genes, Index=0, Wrap=True)  # -> Item, Item1
area = Area(Geometry=srf)  # -> Area, Centroid
vec_2 = VectorXYZ(XComponent=item_2.Item, YComponent=item_2.Item1, ZComponent=0)  # -> Vector, Length
scale = Scale(Geometry=srf, Center=area.Centroid, Factor=number_slider_9)  # -> Geometry, Transform
srf_2 = Surface(cluster)
qgrid = QuadGrid(Surface=scale.Geometry, UDivisions=number_slider_10, VDivisions=number_slider_10)  # -> CornerPoint1, CornerPoint2, CornerPoint3, CornerPoint4, MidPoint, Normals
move_2 = Move(Geometry=srf_2, Motion=vec_2.Vector)  # -> Geometry, Transform
area_2 = Area(Geometry=move_2.Geometry)  # -> Area, Centroid
pt = Point([qgrid.CornerPoint1, qgrid.CornerPoint3, qgrid.CornerPoint2, qgrid.CornerPoint4, qgrid.MidPoint])
incurve = PointInCurve(Point=pt, Curve=scale.Geometry)  # -> Relationship, Point
scale_2 = Scale(Geometry=move_2.Geometry, Center=area_2.Centroid, Factor=number_slider_6)  # -> Geometry, Transform
cull = CullPattern(List=pt, CullPattern=incurve.Relationship)
rotate = Rotate(Geometry=scale_2.Geometry, Angle=degrees(number_slider_7), Plane=area_2.Centroid)  # -> Geometry, Transform
rdiff = RegionDifference(CurvesA=rotate.Geometry, CurvesB=srf)
# Add random rectangle sizes
srf_3 = Surface(rdiff)
cullpt = CullDuplicates(Points=cull, Tolerance=0.1, CullMode=3)  # -> Points, Indices, Valence
dom = ConstructDomain(DomainStart=expr("x/2", number_slider_12), DomainEnd=expr("-x/2", number_slider_12))
dom_2 = ConstructDomain(DomainStart=expr("x/2", number_slider_11), DomainEnd=expr("-x/2", number_slider_11))
rectangle_2 = Rectangle(Plane=cullpt.Points, XSize=dom_2, YSize=dom, Radius=0)  # -> Rectangle, Length
lng = ListLength(List=rectangle_2.Rectangle)
random = Random(Range=Domain(0, 9999), Number=lng, Seed=number_slider_3)
popgeo = PopulateGeometry(Geometry=rectangle_2.Rectangle, Count=graft(number_slider_13), Seed=random)  # -> simplify(Population)
alongcrv = SortAlongCurve(Points=popgeo, Curve=graft(rectangle_2.Rectangle))  # -> Points, Indices
intcrv = Interpolate(Vertices=alongcrv.Points, Degree=3, Periodic=invert(False), KnotStyle=1)  # -> Curve, Length, Domain
item_3 = ListItem(List=genes_4, Index=0, Wrap=True)  # -> Item, Item1, Item2
item_4 = ListItem(List=genes_3, Index=0, Wrap=True)  # -> Item, Item1, Item2
srf_4 = Surface(flatten(intcrv.Curve))
rgb = ColourRGB(Alpha=number_slider_15, Red=item_3.Item, Green=item_3.Item1, Blue=item_3.Item2)
rgb_2 = ColourRGB(Alpha=number_slider_14, Red=item_4.Item, Green=item_4.Item1, Blue=item_4.Item2)
preview = CustomPreview(Geometry=srf_4, Material=rgb)
preview_2 = CustomPreview(Geometry=srf_3, Material=rgb_2)

# ==== cluster Cluster
G = ClusterInput()
A = ClusterInput()
B = ClusterInput()
N = ClusterInput()
S = ClusterInput()
dom = ConstructDomain(DomainStart=A, DomainEnd=B)
popgeo = PopulateGeometry(Geometry=G, Count=N, Seed=S)
area = Area(Geometry=G)  # -> Area, Centroid
random = Random(Range=dom, Number=N, Seed=2)
vec2pt = Vector2Pt(PointA=popgeo, PointB=area.Centroid, Unitize=False)  # -> Vector, Length
amp = Amplitude(Vector=vec2pt.Vector, Amplitude=random)
move = Move(Geometry=popgeo, Motion=amp)  # -> Geometry, Transform
alongcrv = SortAlongCurve(Points=move.Geometry, Curve=G)  # -> Points, Indices
intcrv = Interpolate(Vertices=alongcrv.Points, Degree=3, Periodic=invert(False), KnotStyle=1)  # -> Curve, Length, Domain
C = ClusterOutput(intcrv.Curve)
