# Grasshopper definition cmplx_Ripple Mesh.gh (Grasshopper 1.0.7)
# plug-ins: Pufferfish, Human, Weaverbird

number_slider = Slider(100, range=0..100)
series = Series(Start=0, Step=1, Count=number_slider)
series_2 = Series(Start=0, Step=1, Count=number_slider)
# Script Title: Ripple
# Created by: Michael Hoehn
# Last Modified: 220121
number_slider_2 = Slider(44.323, range=0..100)
pt = ConstructPoint(XCoordinate=series_2, YCoordinate=graft(series), ZCoordinate=0)  # -> flatten(Point)
brec = BoundingRectangle(Geometry=pt, Plane=PlaneXY(0, 0, 0), Axis=0, Slide=0, Union=True)  # -> Bounding, DimensionX, DimensionY
Z = UnitZ(Factor=number_slider_2)
extr = Extrude(Base=brec.Bounding, Direction=Z)
cap = CapHoles(Brep=extr)
number_slider_3 = Slider(1, range=0..1)

max_frame_count = Slider(50, range=1..100)
dom = ConstructDomain(DomainStart="1", DomainEnd=max_frame_count)
remap = RemapNumbers(Value=number_slider_3, Source=Domain(0, 1), Target=dom)  # -> Mapped, Clipped
round = Round(Number=remap.Mapped)  # -> Nearest, Floor, Ceiling
python = GhPythonScript(active=Toggle(False), filePath="E:\NFTs\Sea of Shapes\SeaOfShapes", current=round.Floor)  # -> out, a; inputs current: Int32
# ---------- python: Python ----------
"""Description of Component.
    Inputs:
        x: The x script variable
        y: The y script variable
    Output:
        a: The a output variable"""

import rhinoscriptsyntax as rs

if active: 
    savedLocation = filePath + str(int(current)).zfill(4) +".png"
    rs.Command("-ViewCaptureToFile \n\"" + savedLocation + "\"\n")
# ---------- end python ----------

series_3 = Series(Start=0, Step=Slider(0.721, range=0..1), Count=Slider(1, range=0..10))
pop3d = Populate3D(Region=cap, Count=Slider(6, range=0..100), Seed=Slider(9999, range=0..10000))
addition = Addition(A=number_slider_3, B=series_3)
nurbs = NurbsCurve(Vertices=pop3d, Degree=3, Periodic=False)  # -> Curve, Length, Domain
eval = EvaluateCurve(Curve=reparameterize(nurbs.Curve), Parameter=addition)  # -> Point, Tangent, Angle
sph = Sphere(Base=eval.Point, Radius=Slider(16, range=0..100))
dist = Distance(PointA=pt, PointB=graft(eval.Point))  # -> simplify(Distance)
preview = CustomPreview(Geometry=sph, Material=ColourSwatch(SwatchColor=RGB(0, 0, 0)))
flip = FlipMatrix(Data=dist)
multiplication = Multiplication(A=dist, B=Slider(0.7, range=0.125..0.7))
ma = MassAddition(Input=flip)  # -> flatten(Result), PartialResults
multiplication_2 = Multiplication(A=multiplication, B=Slider(0.001567, range=0..1))
sin = Sine(Value=multiplication)
sin_2 = Sine(Value=ma.Result)
division = Division(A=sin, B=multiplication_2)
multiplication_3 = Multiplication(A=division, B=Slider(0.085288, range=0..1))
flip_2 = FlipMatrix(Data=multiplication_3)
ma_2 = MassAddition(Input=flip_2)  # -> flatten(Result), PartialResults
Z_2 = UnitZ(Factor=ma_2.Result)
move = Move(Geometry=pt, Motion=Z_2)  # -> Geometry, Transform
del = DelaunayMesh(Points=move.Geometry, Plane=PlaneXY(0, 0, 0))
wbfacepolys = WeaverbirdsFacePolylines(Mesh=del)
brec_2 = BoundingRectangle(Geometry=wbfacepolys, Plane=PlaneXY(0, 0, 0), Axis=0, Slide=0, Union=True)  # -> Bounding, DimensionX, DimensionY
explode = Explode(Curve=brec_2.Bounding, Recursive=True)  # -> Segments, Vertices
brec_3 = BoundingRectangle(Geometry=wbfacepolys, Plane=PlaneXY(0, 0, 0), Axis=0, Slide=0, Union=True)  # -> Bounding, DimensionX, DimensionY
item = ListItem(List=explode.Segments, Index=0, Wrap=True)  # -> Item, Item1, Item2, Item3
rot3d = Rotate3D(Geometry=wbfacepolys, Angle=1.570796327, Center=Point(0, 0, 0), Axis=item.Item)  # -> Geometry, Transform
rot3d_2 = Rotate3D(Geometry=wbfacepolys, Angle=1.570796327, Center=Point(0, 0, 0), Axis=item.Item3)  # -> Geometry, Transform
rot3d_3 = Rotate3D(Geometry=brec_3.Bounding, Angle=1.570796327, Center=Point(0, 0, 0), Axis=item.Item)  # -> Geometry, Transform
Y = UnitY(Factor=brec_2.DimensionX)
Z_3 = UnitZ(Factor=brec_2.DimensionX)
entwine = Entwine(Branch00=wbfacepolys, Branch01=rot3d.Geometry, Branch02=rot3d_2.Geometry, FlattenInputs=True)
dash = DashPattern(Curve=nurbs.Curve, Pattern=Slider(3.215, range=0..10))  # -> Dashes, Gaps
previewlw = CustomPreviewLineweights(
    Geometry=entwine,
    Shader=ColourSwatch(SwatchColor=RGB(255, 255, 255)),
    Thickness=Slider(4.752, range=0..10),
    Absolute=False)
previewlw_2 = CustomPreviewLineweights(
    Geometry=dash.Dashes,
    Shader=ColourSwatch(SwatchColor=RGB(0, 0, 0)),
    Thickness=Slider(6.301, range=0..10),
    Absolute=False)
bbox = BoundingBox(Content=flatten(entwine), Plane=PlaneXY(0, 0, 0), UnionBox=True)  # -> Box, Box_2
edges = BrepEdges(Brep=bbox.Box)  # -> Naked, Interior, NonManifold
previewlw_3 = CustomPreviewLineweights(
    Geometry=edges.Interior,
    Shader=ColourSwatch(SwatchColor=RGB(255, 255, 255)),
    Thickness=Slider(10, range=0..10),
    Absolute=False)
