# Grasshopper definition cmplx_packing.gh (Grasshopper 1.0.7)
# plug-ins: Human, Weaverbird, Kangaroo2 Components

X = X(20)
box = CenterBox(Base=PlaneXY(0, 0, 0), X=X, Y=X, Z=X)
number_slider = Slider(10, range=1..25)
brep = Brep(<brep referenced from the Rhino model>)
pop3d = Populate3D(Region=brep, Count=Slider(25, range=0..100), Seed=4)
medges = MeshEdges(Mesh=brep)  # -> NakedEdges, InteriorEdges, NonManifoldEdges
wbicosahedron = WeaverbirdsMeshMeshIcosahedron(Plane=pop3d, Radius=10)
wbloop = WeaverbirdsLoopSubdivision(MeshCurves=wbicosahedron, Level=2, SmoothNakedEdges=1)

# ---- group: collision between ballons
crossref = CrossReference(ListA=flatten(wbloop), ListB=flatten(wbloop), CrossMode=5)  # -> ListA, ListB
demesh = DeconstructMesh(Mesh=crossref.ListB)  # -> Vertices, Faces, Colours, Normals
spc = SolidPointCollide(Points=demesh.Vertices, Solid=graft(crossref.ListA), Interior=False, Unidirectional=False, Strength=1000)

# ---- group: keep balloons in box
demesh_2 = DeconstructMesh(Mesh=wbloop)  # -> Vertices, Faces, Colours, Normals
spc_2 = SolidPointCollide(Points=demesh_2.Vertices, Solid=brep, Interior=True, Unidirectional=True, Strength=10)

# ----
edgelengths = EdgeLengths(Mesh=wbloop, LengthFactor=Slider(1.595, range=0..2), Strength=10)
pressure = Pressure(M=wbloop, Strength=Slider(1, range=0..1))
show = Show(G=wbloop)
entwine = Entwine(Branch00=[edgelengths, spc_2, spc, pressure], Branch01=show, FlattenInputs=True)
solver = Solver(GoalObjects=entwine, Reset=Button(), Threshold=1e-15, Tolerance=0.01, On=Toggle(False))  # -> I, V, O
bang = ExplodeTree(Data=solver.O)  # -> Branch0, Branch1
wbloop_2 = WeaverbirdsLoopSubdivision(MeshCurves=bang.Branch1, Level=1, SmoothNakedEdges=1)
volume = Volume(Geometry=wbloop_2)  # -> Volume, Centroid
preview = CustomPreview(Geometry=wbloop_2, Material=ColourSwatch(SwatchColor=RGB(255, 255, 255)))
meshcp = MeshClosestPoint(Point=volume.Centroid, Mesh=wbloop_2)  # -> Point, Index, Parameter
meval = MeshEval(Mesh=wbloop_2, Parameter=meshcp.Parameter)  # -> Point, Normal, Colour
pl = PlaneNormal(Origin=meshcp.Point, ZAxis=meval.Normal)
contour = Contour(Shape=wbloop_2, Point=pl, Direction=meval.Normal, Distance=Slider(10, range=0.25..10))
explode = Explode(Curve=contour, Recursive=True)  # -> Segments, Vertices
intcrv = Interpolate(Vertices=explode.Vertices, Degree=3, Periodic=False, KnotStyle=1)  # -> Curve, Length, Domain
previewlw = CustomPreviewLineweights(Geometry=intcrv.Curve, Shader=ColourSwatch(SwatchColor=RGB(158, 255, 143)), Absolute=False)
