# Grasshopper definition cmplx_singleLine.gh (Grasshopper 1.0.7)
# plug-ins: Human

number_slider = Slider(125, range=0..500)
timestep_length = Slider(1500, range=0..10000)
timer = Timer(TimerInterval=20, Target=rec)  # disabled
box = CenterBox(Base=PlaneXY(0, 0, 0), X=number_slider, Y=number_slider, Z=number_slider)
rec = DataRecorder(Slider(1, range=0..1), DataLimit=-10, RecordData=True)
pop3d = Populate3D(Region=box, Count=Slider(5, range=0..100), Seed=Slider(5555, range=0..10000))
ma = MassAddition(Input=rec)  # -> Result, PartialResults
dom = ConstructDomain(DomainStart=0, DomainEnd=timestep_length)
intcrv = Interpolate(Vertices=pop3d, Degree=3, Periodic=invert(False), KnotStyle=1)  # -> Curve, Length, Domain
remap = RemapNumbers(Value=ma.Result, Source=dom, Target=Domain(0, 1))  # -> Mapped, Clipped
rail = Curve(intcrv.Curve)
eval = EvaluateCurve(Curve=reparameterize(rail), Parameter=remap.Mapped)  # -> Point, Tangent, Angle
panel = Panel(remap.Mapped)
pl = PlaneNormal(Origin=eval.Point, ZAxis=eval.Tangent)
start_size = Slider(5, range=0..500)
dom_2 = ConstructDomain(DomainStart=Slider(1, range=0..100), DomainEnd=Slider(16, range=0..100))
remap_2 = RemapNumbers(Value=remap.Mapped, Source=Domain(0, 1), Target=dom_2)  # -> Mapped, Clipped
multiplication = Multiplication(A=start_size, B=remap_2.Mapped)
cir = Circle(Plane=pl, Radius=multiplication)
divide = DivideCurve(Curve=cir, Count=Slider(25, range=0..100), Kinks=False)  # -> Points, Tangents, Parameters
rec_2 = DataRecorder(divide.Points, DataLimit=-10, RecordData=True)
flip = FlipMatrix(Data=rec_2)  # -> flatten(Data)
intcrv_2 = Interpolate(Vertices=flip, Degree=3, Periodic=False, KnotStyle=1)  # -> Curve, Length, Domain
previewlw = CustomPreviewLineweights(Geometry=intcrv_2.Curve, Shader=ColourSwatch(SwatchColor=RGB(87, 87, 87)), Absolute=False)
