# Grasshopper definition cmplx_solLewitt.gh (Grasshopper 1.0.7)
# plug-ins: Human

number_slider = Slider(4, range=1..10)
dom = ConstructDomain(DomainStart=expr("x/2", number_slider), DomainEnd=expr("-x/2", number_slider))
number_slider_2 = Slider(4, range=0..10)
rectangle = Rectangle(Plane=PlaneXY(0, 0, 0), XSize=dom, YSize=dom, Radius=0)  # -> Rectangle, Length
crv = Curve(rectangle.Rectangle)
area = Area(Geometry=crv)  # -> Area, Centroid
scale = Scale(Geometry=crv, Center=area.Centroid, Factor=Slider(1.06, range=0..10))  # -> Geometry, Transform
arrrec = RectangularArray(Geometry=crv, Cell=scale.Geometry, XCount=number_slider_2, YCount=number_slider_2)  # -> Geometry, Transform
area_2 = Area(Geometry=arrrec.Geometry)  # -> Area, Centroid
pdecon = Deconstruct(Point=area_2.Centroid)  # -> XComponent, YComponent, ZComponent
sort = SortList(Keys=pdecon.XComponent, ValuesA=arrrec.Geometry)  # -> Keys, ValuesA
partition = PartitionList(List=sort.ValuesA, Size="4")  # -> simplify(Chunks)
area_3 = Area(Geometry=partition)  # -> Area, Centroid
pdecon_2 = Deconstruct(Point=area_3.Centroid)  # -> XComponent, YComponent, ZComponent
sort_2 = SortList(Keys=pdecon_2.YComponent, ValuesA=partition)  # -> Keys, reverse(ValuesA)
sorted_crvs = Curve(sort_2.ValuesA)
bang = ExplodeTree(Data=sorted_crvs)  # -> Branch0, Branch1, Branch2, Branch3
Y = UnitY(Factor=Slider(0.256, range=0..1))
X = UnitX(Factor=Slider(0.186, range=0..1))
neg = Negative(Value=X)
neg_2 = Negative(Value=Y)
panel = Panel("""Straight lines, approximately
one inch long, drawn at
random, within a square
using four directions of line,
each a different color.
1) Yellow / vertical
2) Black / horizontal
3) Red / diagonal, left to right
4) Blue / diagonal, right to left
and all combinations
of these lines and colors.""")
vec2pt = Vector2Pt(PointA=neg, PointB=neg_2, Unitize=False)  # -> Vector, Length
panel_2 = Panel("""B
AC
CD
BCD""")
panel_3 = Panel("""C
AD
ACD
ABCD""")
panel_4 = Panel("""A
AB
BD
ABC""")
panel_5 = Panel("""D
BC
ABD
123""")
area_4 = Area(Geometry=bang.Branch1)  # -> Area, Centroid
area_5 = Area(Geometry=bang.Branch2)  # -> Area, Centroid
area_6 = Area(Geometry=bang.Branch3)  # -> Area, Centroid
area_7 = Area(Geometry=bang.Branch0)  # -> Area, Centroid
tag = TextTag(Location=area_4.Centroid, Text=panel_2)
tag_2 = TextTag(Location=area_5.Centroid, Text=panel_3)
lng = ListLength(List=panel)
series = Series(Start=0, Step=Slider(-0.3682, range=-5..5), Count=lng)
tag_3 = TextTag(Location=area_6.Centroid, Text=panel_5)

number_slider_3 = Slider(400, range=0..1000)
number_slider_4 = Slider(5555, range=0..10000)

tag_4 = TextTag(Location=area_7.Centroid, Text=panel_4)
Y_2 = UnitY(Factor=series)
item = ListItem(List=bang.Branch0, Index=0, Wrap=True)  # -> Item, Item1, Item2, Item3
item_2 = ListItem(List=bang.Branch1, Index=0, Wrap=True)  # -> Item, Item1, Item2, Item3
item_3 = ListItem(List=bang.Branch2, Index=0, Wrap=True)  # -> Item, Item1, Item2, Item3
item_4 = ListItem(List=bang.Branch3, Index=0, Wrap=True)  # -> Item, Item1, Item2, Item3
explode = Explode(Curve=item_4.Item3, Recursive=True)  # -> Segments, Vertices
move = Move(Geometry=explode.Vertices, Motion=vec2pt.Vector)  # -> Geometry, Transform
item_5 = ListItem(List=move.Geometry, Index=0, Wrap=True)  # -> Item, Item1, Item2, Item3
move_2 = Move(Geometry=item_5.Item3, Motion=Y_2)  # -> Geometry, Transform
tag_5 = TextTag3D(
    Location=move_2.Geometry,
    Text=panel,
    Size=Slider(0.1492, range=0..1),
    Colour=ColourSwatch(SwatchColor=RGB(0, 0, 0)),
    Justification=7)

X_2 = UnitX(Factor=1)
Y_3 = UnitY(Factor=1)
vec2pt_2 = Vector2Pt(PointA=X_2, PointB=Y_3, Unitize=False)  # -> Vector, Length
abs = Absolute(Value=vec2pt_2.Vector)
cluster = Cluster(square=item_4.Item1, number=number_slider_3, seed=expr("X*350", number_slider_4), direction=abs)  # -> geo, T, stroke
bnd = Bounds(Numbers=cluster.T)
dedomain = DeconstructDomain(Domain=bnd)  # -> Start, End
gradient = Gradient(
    LowerLimit=dedomain.Start,
    UpperLimit=dedomain.End,
    Parameter=cluster.T,
    stops=[0.15: RGB(255, 130, 160), 0.85: RGB(255, 228, 225)])
previewlw = CustomPreviewLineweights(Geometry=cluster.geo, Shader=gradient, Thickness=cluster.stroke, Absolute=False)

X_3 = UnitX(Factor=1)
Y_4 = UnitY(Factor=1)
vec2pt_3 = Vector2Pt(PointA=X_3, PointB=Y_4, Unitize=False)  # -> Vector, Length
abs_2 = Absolute(Value=vec2pt_3.Vector)
cluster_2 = Cluster(square=item_3.Item, number=number_slider_3, seed=expr("X*3", number_slider_4), direction=abs_2)  # -> geo, T, stroke
bnd_2 = Bounds(Numbers=cluster_2.T)
dedomain_2 = DeconstructDomain(Domain=bnd_2)  # -> Start, End
gradient_2 = Gradient(
    LowerLimit=dedomain_2.Start,
    UpperLimit=dedomain_2.End,
    Parameter=cluster_2.T,
    stops=[0.15: RGB(255, 130, 160), 0.85: RGB(255, 228, 225)])
previewlw_2 = CustomPreviewLineweights(Geometry=cluster_2.geo, Shader=gradient_2, Thickness=cluster_2.stroke, Absolute=False)

X_4 = UnitX(Factor=1)
Y_5 = UnitY(Factor=1)
vec2pt_4 = Vector2Pt(PointA=X_4, PointB=Y_5, Unitize=False)  # -> Vector, Length
abs_3 = Absolute(Value=vec2pt_4.Vector)
cluster_3 = Cluster(square=item_2.Item2, number=number_slider_3, seed=expr("X*335", number_slider_4), direction=abs_3)  # -> geo, T, stroke
bnd_3 = Bounds(Numbers=cluster_3.T)
dedomain_3 = DeconstructDomain(Domain=bnd_3)  # -> Start, End
gradient_3 = Gradient(
    LowerLimit=dedomain_3.Start,
    UpperLimit=dedomain_3.End,
    Parameter=cluster_3.T,
    stops=[0.15: RGB(255, 130, 160), 0.85: RGB(255, 228, 225)])
previewlw_3 = CustomPreviewLineweights(Geometry=cluster_3.geo, Shader=gradient_3, Thickness=cluster_3.stroke, Absolute=False)

X_5 = UnitX(Factor=1)
Y_6 = UnitY(Factor=1)
vec2pt_5 = Vector2Pt(PointA=X_5, PointB=Y_6, Unitize=False)  # -> Vector, Length
cluster_4 = Cluster(square=item.Item2, number=number_slider_3, seed=expr("X*402", number_slider_4), direction=vec2pt_5.Vector)  # -> geo, T, stroke
bnd_4 = Bounds(Numbers=cluster_4.T)
dedomain_4 = DeconstructDomain(Domain=bnd_4)  # -> Start, End
gradient_4 = Gradient(
    LowerLimit=dedomain_4.Start,
    UpperLimit=dedomain_4.End,
    Parameter=cluster_4.T,
    stops=[0.15: RGB(185, 209, 234), 0.85: RGB(240, 255, 255)])
previewlw_4 = CustomPreviewLineweights(Geometry=cluster_4.geo, Shader=gradient_4, Thickness=cluster_4.stroke, Absolute=False)

X_6 = UnitX(Factor=1)
Y_7 = UnitY(Factor=1)
Y_8 = UnitY(Factor=1)
vec2pt_6 = Vector2Pt(PointA=X_6, PointB=Y_7, Unitize=False)  # -> Vector, Length
square = Curve(item_4.Item2)
X_7 = UnitX(Factor=1)
cluster_5 = Cluster(square=square, number=number_slider_3, seed=expr("X*25", number_slider_4), direction=vec2pt_6.Vector)  # -> geo, T, stroke
cluster_6 = Cluster(square=square, number=number_slider_3, seed=expr("X/42069", number_slider_4), direction=X_7)  # -> geo, T, stroke
cluster_7 = Cluster(square=square, number=number_slider_3, seed=expr("X*42069", number_slider_4), direction=Y_8)  # -> geo, T, stroke
bnd_5 = Bounds(Numbers=cluster_5.T)
bnd_6 = Bounds(Numbers=cluster_6.T)
bnd_7 = Bounds(Numbers=cluster_7.T)
dedomain_5 = DeconstructDomain(Domain=bnd_5)  # -> Start, End
dedomain_6 = DeconstructDomain(Domain=bnd_6)  # -> Start, End
dedomain_7 = DeconstructDomain(Domain=bnd_7)  # -> Start, End
gradient_5 = Gradient(
    LowerLimit=dedomain_5.Start,
    UpperLimit=dedomain_5.End,
    Parameter=cluster_5.T,
    stops=[0.15: RGB(185, 209, 234), 0.85: RGB(240, 255, 255)])
gradient_6 = Gradient(
    LowerLimit=dedomain_6.Start,
    UpperLimit=dedomain_6.End,
    Parameter=cluster_6.T,
    stops=[0.444: RGB(255, 245, 238), 1: RGB(215, 228, 242)])
gradient_7 = Gradient(
    LowerLimit=dedomain_7.Start,
    UpperLimit=dedomain_7.End,
    Parameter=cluster_7.T,
    stops=[0: RGB(245, 245, 220), 1: RGB(255, 255, 192)])
previewlw_5 = CustomPreviewLineweights(Geometry=cluster_5.geo, Shader=gradient_5, Thickness=cluster_5.stroke, Absolute=False)
previewlw_6 = CustomPreviewLineweights(Geometry=cluster_6.geo, Shader=gradient_6, Thickness=cluster_6.stroke, Absolute=False)
previewlw_7 = CustomPreviewLineweights(Geometry=cluster_7.geo, Shader=gradient_7, Thickness=cluster_7.stroke, Absolute=False)

X_8 = UnitX(Factor=1)
Y_9 = UnitY(Factor=1)
vec2pt_7 = Vector2Pt(PointA=X_8, PointB=Y_9, Unitize=False)  # -> Vector, Length
cluster_8 = Cluster(square=item_4.Item, number=number_slider_3, seed=expr("X*4", number_slider_4), direction=vec2pt_7.Vector)  # -> geo, T, stroke
bnd_8 = Bounds(Numbers=cluster_8.T)
dedomain_8 = DeconstructDomain(Domain=bnd_8)  # -> Start, End
gradient_8 = Gradient(
    LowerLimit=dedomain_8.Start,
    UpperLimit=dedomain_8.End,
    Parameter=cluster_8.T,
    stops=[0.15: RGB(185, 209, 234), 0.85: RGB(240, 255, 255)])
previewlw_8 = CustomPreviewLineweights(Geometry=cluster_8.geo, Shader=gradient_8, Thickness=cluster_8.stroke, Absolute=False)

X_9 = UnitX(Factor=1)
Y_10 = UnitY(Factor=1)
vec2pt_8 = Vector2Pt(PointA=X_9, PointB=Y_10, Unitize=False)  # -> Vector, Length
cluster_9 = Cluster(square=item_2.Item2, number=number_slider_3, seed=expr("X*44", number_slider_4), direction=vec2pt_8.Vector)  # -> geo, T, stroke
bnd_9 = Bounds(Numbers=cluster_9.T)
dedomain_9 = DeconstructDomain(Domain=bnd_9)  # -> Start, End
gradient_9 = Gradient(
    LowerLimit=dedomain_9.Start,
    UpperLimit=dedomain_9.End,
    Parameter=cluster_9.T,
    stops=[0.15: RGB(185, 209, 234), 0.85: RGB(240, 255, 255)])
previewlw_9 = CustomPreviewLineweights(Geometry=cluster_9.geo, Shader=gradient_9, Thickness=cluster_9.stroke, Absolute=False)

Y_11 = UnitY(Factor=1)
square_2 = Curve(item_3.Item2)
cluster_10 = Cluster(square=square_2, number=number_slider_3, seed=number_slider_4, direction=Y_11)  # -> geo, T, stroke
bnd_10 = Bounds(Numbers=cluster_10.T)
dedomain_10 = DeconstructDomain(Domain=bnd_10)  # -> Start, End
gradient_10 = Gradient(
    LowerLimit=dedomain_10.Start,
    UpperLimit=dedomain_10.End,
    Parameter=cluster_10.T,
    stops=[0: RGB(245, 245, 220), 1: RGB(255, 255, 192)])
previewlw_10 = CustomPreviewLineweights(Geometry=cluster_10.geo, Shader=gradient_10, Thickness=cluster_10.stroke, Absolute=False)

X_10 = UnitX(Factor=1)
Y_12 = UnitY(Factor=1)
vec2pt_9 = Vector2Pt(PointA=X_10, PointB=Y_12, Unitize=False)  # -> Vector, Length
abs_4 = Absolute(Value=vec2pt_9.Vector)
cluster_11 = Cluster(square=square_2, number=number_slider_3, seed=expr("X*3", number_slider_4), direction=abs_4)  # -> geo, T, stroke
bnd_11 = Bounds(Numbers=cluster_11.T)
dedomain_11 = DeconstructDomain(Domain=bnd_11)  # -> Start, End
gradient_11 = Gradient(
    LowerLimit=dedomain_11.Start,
    UpperLimit=dedomain_11.End,
    Parameter=cluster_11.T,
    stops=[0.15: RGB(255, 130, 160), 0.85: RGB(255, 228, 225)])
previewlw_11 = CustomPreviewLineweights(Geometry=cluster_11.geo, Shader=gradient_11, Thickness=cluster_11.stroke, Absolute=False)

X_11 = UnitX(Factor=1)
Y_13 = UnitY(Factor=1)
vec2pt_10 = Vector2Pt(PointA=X_11, PointB=Y_13, Unitize=False)  # -> Vector, Length
cluster_12 = Cluster(square=square_2, number=number_slider_3, seed=expr("X*4", number_slider_4), direction=vec2pt_10.Vector)  # -> geo, T, stroke
bnd_12 = Bounds(Numbers=cluster_12.T)
dedomain_12 = DeconstructDomain(Domain=bnd_12)  # -> Start, End
gradient_12 = Gradient(
    LowerLimit=dedomain_12.Start,
    UpperLimit=dedomain_12.End,
    Parameter=cluster_12.T,
    stops=[0.15: RGB(185, 209, 234), 0.85: RGB(240, 255, 255)])
previewlw_12 = CustomPreviewLineweights(Geometry=cluster_12.geo, Shader=gradient_12, Thickness=cluster_12.stroke, Absolute=False)

Y_14 = UnitY(Factor=1)
square_3 = Curve(item_3.Item1)
cluster_13 = Cluster(square=square_3, number=number_slider_3, seed=expr("X*789", number_slider_4), direction=Y_14)  # -> geo, T, stroke
bnd_13 = Bounds(Numbers=cluster_13.T)
dedomain_13 = DeconstructDomain(Domain=bnd_13)  # -> Start, End
gradient_13 = Gradient(
    LowerLimit=dedomain_13.Start,
    UpperLimit=dedomain_13.End,
    Parameter=cluster_13.T,
    stops=[0: RGB(245, 245, 220), 1: RGB(255, 255, 192)])
previewlw_13 = CustomPreviewLineweights(Geometry=cluster_13.geo, Shader=gradient_13, Thickness=cluster_13.stroke, Absolute=False)

X_12 = UnitX(Factor=1)
Y_15 = UnitY(Factor=1)
vec2pt_11 = Vector2Pt(PointA=X_12, PointB=Y_15, Unitize=False)  # -> Vector, Length
cluster_14 = Cluster(square=square_3, number=number_slider_3, seed=expr("X*48", number_slider_4), direction=vec2pt_11.Vector)  # -> geo, T, stroke
bnd_14 = Bounds(Numbers=cluster_14.T)
dedomain_14 = DeconstructDomain(Domain=bnd_14)  # -> Start, End
gradient_14 = Gradient(
    LowerLimit=dedomain_14.Start,
    UpperLimit=dedomain_14.End,
    Parameter=cluster_14.T,
    stops=[0.15: RGB(185, 209, 234), 0.85: RGB(240, 255, 255)])
previewlw_14 = CustomPreviewLineweights(Geometry=cluster_14.geo, Shader=gradient_14, Thickness=cluster_14.stroke, Absolute=False)

Y_16 = UnitY(Factor=1)
square_4 = Curve(item.Item)
cluster_15 = Cluster(square=square_4, number=number_slider_3, seed=number_slider_4, direction=Y_16)  # -> geo, T, stroke
bnd_15 = Bounds(Numbers=cluster_15.T)
dedomain_15 = DeconstructDomain(Domain=bnd_15)  # -> Start, End
gradient_15 = Gradient(
    LowerLimit=dedomain_15.Start,
    UpperLimit=dedomain_15.End,
    Parameter=cluster_15.T,
    stops=[0: RGB(245, 245, 220), 1: RGB(255, 255, 192)])
previewlw_15 = CustomPreviewLineweights(Geometry=cluster_15.geo, Shader=gradient_15, Thickness=cluster_15.stroke, Absolute=False)

Y_17 = UnitY(Factor=1)
square_5 = Curve(item.Item1)
cluster_16 = Cluster(square=square_5, number=number_slider_3, seed=expr("X/5.5", number_slider_4), direction=Y_17)  # -> geo, T, stroke
bnd_16 = Bounds(Numbers=cluster_16.T)
dedomain_16 = DeconstructDomain(Domain=bnd_16)  # -> Start, End
gradient_16 = Gradient(
    LowerLimit=dedomain_16.Start,
    UpperLimit=dedomain_16.End,
    Parameter=cluster_16.T,
    stops=[0: RGB(245, 245, 220), 1: RGB(255, 255, 192)])
previewlw_16 = CustomPreviewLineweights(Geometry=cluster_16.geo, Shader=gradient_16, Thickness=cluster_16.stroke, Absolute=False)

Y_18 = UnitY(Factor=1)
square_6 = Curve(item_2.Item1)
cluster_17 = Cluster(square=square_6, number=number_slider_3, seed=expr("X*3.258", number_slider_4), direction=Y_18)  # -> geo, T, stroke
bnd_17 = Bounds(Numbers=cluster_17.T)
dedomain_17 = DeconstructDomain(Domain=bnd_17)  # -> Start, End
gradient_17 = Gradient(
    LowerLimit=dedomain_17.Start,
    UpperLimit=dedomain_17.End,
    Parameter=cluster_17.T,
    stops=[0: RGB(245, 245, 220), 1: RGB(255, 255, 192)])
previewlw_17 = CustomPreviewLineweights(Geometry=cluster_17.geo, Shader=gradient_17, Thickness=cluster_17.stroke, Absolute=False)

X_13 = UnitX(Factor=1)
Y_19 = UnitY(Factor=1)
vec2pt_12 = Vector2Pt(PointA=X_13, PointB=Y_19, Unitize=False)  # -> Vector, Length
abs_5 = Absolute(Value=vec2pt_12.Vector)
cluster_18 = Cluster(square=square_6, number=number_slider_3, seed=expr("X*35", number_slider_4), direction=abs_5)  # -> geo, T, stroke
bnd_18 = Bounds(Numbers=cluster_18.T)
dedomain_18 = DeconstructDomain(Domain=bnd_18)  # -> Start, End
gradient_18 = Gradient(
    LowerLimit=dedomain_18.Start,
    UpperLimit=dedomain_18.End,
    Parameter=cluster_18.T,
    stops=[0.15: RGB(255, 130, 160), 0.85: RGB(255, 228, 225)])
previewlw_18 = CustomPreviewLineweights(Geometry=cluster_18.geo, Shader=gradient_18, Thickness=cluster_18.stroke, Absolute=False)

X_14 = UnitX(Factor=1)
cluster_19 = Cluster(square=item.Item2, number=number_slider_3, seed=expr("X*2058", number_slider_4), direction=X_14)  # -> geo, T, stroke
bnd_19 = Bounds(Numbers=cluster_19.T)
dedomain_19 = DeconstructDomain(Domain=bnd_19)  # -> Start, End
gradient_19 = Gradient(
    LowerLimit=dedomain_19.Start,
    UpperLimit=dedomain_19.End,
    Parameter=cluster_19.T,
    stops=[0.444: RGB(255, 245, 238), 1: RGB(215, 228, 242)])
previewlw_19 = CustomPreviewLineweights(Geometry=cluster_19.geo, Shader=gradient_19, Thickness=cluster_19.stroke, Absolute=False)

X_15 = UnitX(Factor=1)
cluster_20 = Cluster(square=item_4.Item1, number=number_slider_3, seed=expr("X*265", number_slider_4), direction=X_15)  # -> geo, T, stroke
bnd_20 = Bounds(Numbers=cluster_20.T)
dedomain_20 = DeconstructDomain(Domain=bnd_20)  # -> Start, End
gradient_20 = Gradient(
    LowerLimit=dedomain_20.Start,
    UpperLimit=dedomain_20.End,
    Parameter=cluster_20.T,
    stops=[0.444: RGB(255, 245, 238), 1: RGB(215, 228, 242)])
previewlw_20 = CustomPreviewLineweights(Geometry=cluster_20.geo, Shader=gradient_20, Thickness=cluster_20.stroke, Absolute=False)

X_16 = UnitX(Factor=1)
cluster_21 = Cluster(square=item.Item1, number=number_slider_3, seed=expr("X*25", number_slider_4), direction=X_16)  # -> geo, T, stroke
bnd_21 = Bounds(Numbers=cluster_21.T)
dedomain_21 = DeconstructDomain(Domain=bnd_21)  # -> Start, End
gradient_21 = Gradient(
    LowerLimit=dedomain_21.Start,
    UpperLimit=dedomain_21.End,
    Parameter=cluster_21.T,
    stops=[0.444: RGB(255, 245, 238), 1: RGB(215, 228, 242)])
previewlw_21 = CustomPreviewLineweights(Geometry=cluster_21.geo, Shader=gradient_21, Thickness=cluster_21.stroke, Absolute=False)

X_17 = UnitX(Factor=1)
cluster_22 = Cluster(square=item_2.Item, number=number_slider_3, seed=expr("X*2", number_slider_4), direction=X_17)  # -> geo, T, stroke
bnd_22 = Bounds(Numbers=cluster_22.T)
dedomain_22 = DeconstructDomain(Domain=bnd_22)  # -> Start, End
gradient_22 = Gradient(
    LowerLimit=dedomain_22.Start,
    UpperLimit=dedomain_22.End,
    Parameter=cluster_22.T,
    stops=[0.444: RGB(255, 245, 238), 1: RGB(215, 228, 242)])
previewlw_22 = CustomPreviewLineweights(Geometry=cluster_22.geo, Shader=gradient_22, Thickness=cluster_22.stroke, Absolute=False)

cluster_23 = Cluster_2(point_a=item.Item, point_b=item.Item1, geometry_to_move=cluster_15.geo)  # disabled

Y_20 = UnitY(Factor=1)
square_7 = Curve(item.Item3)
cluster_24 = Cluster(square=square_7, number=number_slider_3, seed=expr("X+2", number_slider_4), direction=Y_20)  # -> geo, T, stroke
bnd_23 = Bounds(Numbers=cluster_24.T)
dedomain_23 = DeconstructDomain(Domain=bnd_23)  # -> Start, End
gradient_23 = Gradient(
    LowerLimit=dedomain_23.Start,
    UpperLimit=dedomain_23.End,
    Parameter=cluster_24.T,
    stops=[0: RGB(245, 245, 220), 1: RGB(255, 255, 192)])
previewlw_23 = CustomPreviewLineweights(Geometry=cluster_24.geo, Shader=gradient_23, Thickness=cluster_24.stroke, Absolute=False)

X_18 = UnitX(Factor=1)
Y_21 = UnitY(Factor=1)
vec2pt_13 = Vector2Pt(PointA=X_18, PointB=Y_21, Unitize=False)  # -> Vector, Length
abs_6 = Absolute(Value=vec2pt_13.Vector)
cluster_25 = Cluster(square=square_7, number=number_slider_3, seed=expr("X+96", number_slider_4), direction=abs_6)  # -> geo, T, stroke
bnd_24 = Bounds(Numbers=cluster_25.T)
dedomain_24 = DeconstructDomain(Domain=bnd_24)  # -> Start, End
gradient_24 = Gradient(
    LowerLimit=dedomain_24.Start,
    UpperLimit=dedomain_24.End,
    Parameter=cluster_25.T,
    stops=[0.15: RGB(255, 130, 160), 0.85: RGB(255, 228, 225)])
previewlw_24 = CustomPreviewLineweights(Geometry=cluster_25.geo, Shader=gradient_24, Thickness=cluster_25.stroke, Absolute=False)

X_19 = UnitX(Factor=1)
cluster_26 = Cluster(square=square_7, number=number_slider_3, seed=expr("X*22.3", number_slider_4), direction=X_19)  # -> geo, T, stroke
bnd_25 = Bounds(Numbers=cluster_26.T)
dedomain_25 = DeconstructDomain(Domain=bnd_25)  # -> Start, End
gradient_25 = Gradient(
    LowerLimit=dedomain_25.Start,
    UpperLimit=dedomain_25.End,
    Parameter=cluster_26.T,
    stops=[0.444: RGB(255, 245, 238), 1: RGB(215, 228, 242)])
previewlw_25 = CustomPreviewLineweights(Geometry=cluster_26.geo, Shader=gradient_25, Thickness=cluster_26.stroke, Absolute=False)

X_20 = UnitX(Factor=1)
Y_22 = UnitY(Factor=1)
vec2pt_14 = Vector2Pt(PointA=X_20, PointB=Y_22, Unitize=False)  # -> Vector, Length
abs_7 = Absolute(Value=vec2pt_14.Vector)
cluster_27 = Cluster(square=item_2.Item3, number=number_slider_3, seed=expr("X+63", number_slider_4), direction=abs_7)  # -> geo, T, stroke
bnd_26 = Bounds(Numbers=cluster_27.T)
dedomain_26 = DeconstructDomain(Domain=bnd_26)  # -> Start, End
gradient_26 = Gradient(
    LowerLimit=dedomain_26.Start,
    UpperLimit=dedomain_26.End,
    Parameter=cluster_27.T,
    stops=[0.15: RGB(255, 130, 160), 0.85: RGB(255, 228, 225)])
previewlw_26 = CustomPreviewLineweights(Geometry=cluster_27.geo, Shader=gradient_26, Thickness=cluster_27.stroke, Absolute=False)

X_21 = UnitX(Factor=1)
Y_23 = UnitY(Factor=1)
vec2pt_15 = Vector2Pt(PointA=X_21, PointB=Y_23, Unitize=False)  # -> Vector, Length
cluster_28 = Cluster(square=item_2.Item3, number=number_slider_3, seed=expr("X*4", number_slider_4), direction=vec2pt_15.Vector)  # -> geo, T, stroke
bnd_27 = Bounds(Numbers=cluster_28.T)
dedomain_27 = DeconstructDomain(Domain=bnd_27)  # -> Start, End
gradient_27 = Gradient(
    LowerLimit=dedomain_27.Start,
    UpperLimit=dedomain_27.End,
    Parameter=cluster_28.T,
    stops=[0.15: RGB(185, 209, 234), 0.85: RGB(240, 255, 255)])
previewlw_27 = CustomPreviewLineweights(Geometry=cluster_28.geo, Shader=gradient_27, Thickness=cluster_28.stroke, Absolute=False)

Y_24 = UnitY(Factor=1)
square_8 = Curve(item_3.Item3)
cluster_29 = Cluster(square=square_8, number=number_slider_3, seed=expr("X*25", number_slider_4), direction=Y_24)  # -> geo, T, stroke
bnd_28 = Bounds(Numbers=cluster_29.T)
dedomain_28 = DeconstructDomain(Domain=bnd_28)  # -> Start, End
gradient_28 = Gradient(
    LowerLimit=dedomain_28.Start,
    UpperLimit=dedomain_28.End,
    Parameter=cluster_29.T,
    stops=[0: RGB(245, 245, 220), 1: RGB(255, 255, 192)])
previewlw_28 = CustomPreviewLineweights(Geometry=cluster_29.geo, Shader=gradient_28, Thickness=cluster_29.stroke, Absolute=False)

X_22 = UnitX(Factor=1)
Y_25 = UnitY(Factor=1)
vec2pt_16 = Vector2Pt(PointA=X_22, PointB=Y_25, Unitize=False)  # -> Vector, Length
abs_8 = Absolute(Value=vec2pt_16.Vector)
cluster_30 = Cluster(square=square_8, number=number_slider_3, seed=expr("X*37", number_slider_4), direction=abs_8)  # -> geo, T, stroke
bnd_29 = Bounds(Numbers=cluster_30.T)
dedomain_29 = DeconstructDomain(Domain=bnd_29)  # -> Start, End
gradient_29 = Gradient(
    LowerLimit=dedomain_29.Start,
    UpperLimit=dedomain_29.End,
    Parameter=cluster_30.T,
    stops=[0.15: RGB(255, 130, 160), 0.85: RGB(255, 228, 225)])
previewlw_29 = CustomPreviewLineweights(Geometry=cluster_30.geo, Shader=gradient_29, Thickness=cluster_30.stroke, Absolute=False)

X_23 = UnitX(Factor=1)
Y_26 = UnitY(Factor=1)
vec2pt_17 = Vector2Pt(PointA=X_23, PointB=Y_26, Unitize=False)  # -> Vector, Length
cluster_31 = Cluster(square=square_8, number=number_slider_3, seed=expr("X*463", number_slider_4), direction=vec2pt_17.Vector)  # -> geo, T, stroke
bnd_30 = Bounds(Numbers=cluster_31.T)
dedomain_30 = DeconstructDomain(Domain=bnd_30)  # -> Start, End
gradient_30 = Gradient(
    LowerLimit=dedomain_30.Start,
    UpperLimit=dedomain_30.End,
    Parameter=cluster_31.T,
    stops=[0.15: RGB(185, 209, 234), 0.85: RGB(240, 255, 255)])
previewlw_30 = CustomPreviewLineweights(Geometry=cluster_31.geo, Shader=gradient_30, Thickness=cluster_31.stroke, Absolute=False)

X_24 = UnitX(Factor=1)
cluster_32 = Cluster(square=square_8, number=number_slider_3, seed=expr("X*27", number_slider_4), direction=X_24)  # -> geo, T, stroke
bnd_31 = Bounds(Numbers=cluster_32.T)
dedomain_31 = DeconstructDomain(Domain=bnd_31)  # -> Start, End
gradient_31 = Gradient(
    LowerLimit=dedomain_31.Start,
    UpperLimit=dedomain_31.End,
    Parameter=cluster_32.T,
    stops=[0.444: RGB(255, 245, 238), 1: RGB(215, 228, 242)])
previewlw_31 = CustomPreviewLineweights(Geometry=cluster_32.geo, Shader=gradient_31, Thickness=cluster_32.stroke, Absolute=False)

X_25 = UnitX(Factor=1)
cluster_33 = Cluster(square=item_2.Item3, number=number_slider_3, seed=expr("X*247", number_slider_4), direction=X_25)  # -> geo, T, stroke
bnd_32 = Bounds(Numbers=cluster_33.T)
dedomain_32 = DeconstructDomain(Domain=bnd_32)  # -> Start, End
gradient_32 = Gradient(
    LowerLimit=dedomain_32.Start,
    UpperLimit=dedomain_32.End,
    Parameter=cluster_33.T,
    stops=[0.444: RGB(255, 245, 238), 1: RGB(215, 228, 242)])
previewlw_32 = CustomPreviewLineweights(Geometry=cluster_33.geo, Shader=gradient_32, Thickness=cluster_33.stroke, Absolute=False)

# ==== cluster Cluster
square = ClusterInput()
direction = ClusterInput()
number = ClusterInput()
seed = ClusterInput()
pop2d = Populate2D(Region=square, Count=number, Seed=seed)
crv = Curve(square)
line = LineSDL(Start=pop2d, Direction=direction, Length=1)
dom = ConstructDomain(DomainStart=Slider(-1, range=-1..1), DomainEnd=Slider(1, range=0..1))
lng = ListLength(List=line)
random = Random(Range=dom, Number=lng, Seed=seed)
Y = UnitY(Factor=1)
jitter = Jitter(List=random, Jitter=1, Seed=2)  # -> Values, Indices
amp = Amplitude(Vector=Y, Amplitude=jitter.Values)
X = UnitX(Factor=jitter.Values)
move = Move(Geometry=line, Motion=amp)  # -> Geometry, Transform
move_2 = Move(Geometry=move.Geometry, Motion=X)  # -> Geometry, Transform
crv_2 = Curve(move_2.Geometry)
split = SplitWithBrep(Curve=crv_2, Brep=square)  # -> Curve, Points
crv_3 = Curve(split.Curve)
curvepoint = PointOnCurve(crv_3, parameter=0.5)
incurve = PointInCurve(Point=curvepoint, Curve=square)  # -> Relationship, Point
dom_2 = ConstructDomain(DomainStart=Slider(0.374, range=0..5), DomainEnd=Slider(10, range=0..10))
cull = CullPattern(List=crv_3, CullPattern=incurve.Relationship)  # -> flatten(List)
lng_2 = ListLength(List=cull)
random_2 = Random(Range=dom_2, Number=lng_2, Seed=seed)
remap = RemapNumbers(Value=random_2, Source=Domain(0, 1), Target=Domain(0, 1))  # -> Mapped, Clipped
T = ClusterOutput(remap.Mapped)
stroke = ClusterOutput(random_2)
geo = ClusterOutput(cull)

# ==== cluster Cluster_2
geometry_to_move = ClusterInput()
point_b = ClusterInput()
point_a = ClusterInput()
area = Area(Geometry=point_b)  # -> Area, Centroid
area_2 = Area(Geometry=point_a)  # -> Area, Centroid
vec2pt = Vector2Pt(PointA=area_2.Centroid, PointB=area.Centroid, Unitize=False)  # -> Vector, Length
move = Move(Geometry=geometry_to_move, Motion=vec2pt.Vector)  # -> Geometry, Transform
G = ClusterOutput(move.Geometry)
