# Grasshopper definition cmplx_space.gh (Grasshopper 1.0.7)
# plug-ins: Human

number_slider = Slider(3, range=0..10)
series = Series(Start=Slider(9, range=0..10), Step=number_slider, Count=Slider(2, range=0..10))
number_slider_2 = Slider(3, range=0..100)
item = ListItem(List=series, Index=0, Wrap=True)  # -> Item, Item1
brep = Brep(<brep referenced from the Rhino model>)
series_2 = Series(Start=item.Item, Step=1, Count=number_slider)
series_3 = Series(Start=item.Item1, Step=1, Count=number_slider)
random = Random(Range=Domain(0, 1), Number=number_slider_2, Seed=series_2)
random_2 = Random(Range=Domain(0, 1), Number=number_slider_2, Seed=series_3)
flip = FlipMatrix(Data=random)
flip_2 = FlipMatrix(Data=random_2)
pop3d = Populate3D(Region=brep, Count=number_slider_2, Seed=Slider(5000, range=0..10000))
item_2 = ListItem(List=flip, Index=0, Wrap=True)  # -> Item, Item1, Item2
item_3 = ListItem(List=flip_2, Index=0, Wrap=True)  # -> Item, Item1, Item2
pt = ConstructPoint(XCoordinate=item_2.Item, YCoordinate=item_2.Item1, ZCoordinate=item_2.Item2)
pt_2 = ConstructPoint(XCoordinate=item_3.Item, YCoordinate=item_3.Item1, ZCoordinate=item_3.Item2)
pl = ConstructPlane(Origin=graft(pop3d), XAxis=pt, YAxis=pt_2)  # -> flatten(Plane)
sec = BrepPlane(Brep=brep, Plane=pl)  # -> Curves, Points
srf = Surface(simplify(sec.Curves))
number_slider_3 = Slider(25, range=1..100)
area = Area(Geometry=srf)  # -> Area, Centroid
evalsrf = EvaluateSurface(Surface=reparameterize(srf), Point="0.5, 0.5")  # -> Point, Normal, UDirection, VDirection, Frame
scale = Scale(Geometry=srf, Center=area.Centroid, Factor=Slider(2.53, range=0..50))  # -> Geometry, Transform
neg = Negative(Value=evalsrf.Normal)
addition = Addition(A=number_slider_3, B=number_slider_3)
amp = Amplitude(Vector=evalsrf.Normal, Amplitude=addition)
amp_2 = Amplitude(Vector=neg, Amplitude=number_slider_3)
move = Move(Geometry=srf, Motion=amp_2)  # -> Geometry, Transform
extr = Extrude(Base=move.Geometry, Direction=amp)  # -> flatten(Extrusion)
volume = Volume(Geometry=brep)  # -> Volume, Centroid
sdiff = SolidDifference(BrepsA=brep, BrepsB=extr)
volume_2 = Volume(Geometry=sdiff)  # -> Volume, Centroid
vec2pt = Vector2Pt(PointA=volume.Centroid, PointB=volume_2.Centroid, Unitize=False)  # -> Vector, Length
amp_3 = Amplitude(Vector=vec2pt.Vector, Amplitude=Slider(25.018, range=0..100))
line = LineSDL(Start=volume.Centroid, Direction=vec2pt.Vector, Length=Slider(195, range=0..1000))
move_2 = Move(Geometry=sdiff, Motion=expr("x/5", amp_3))  # -> Geometry, Transform
end = EndPoints(Curve=line)  # -> Start, End
move_3 = Move(Geometry=move_2.Geometry, Motion=expr("x/4", amp_3))  # -> Geometry, Transform
move_4 = Move(Geometry=move_3.Geometry, Motion=expr("x/2", amp_3))  # -> Geometry, Transform
move_5 = Move(Geometry=move_4.Geometry, Motion=expr("x/1.5", amp_3))  # -> Geometry, Transform
dots = DotDisplay(Point=end.End, Colour=ColourSwatch(SwatchColor=RGB(255, 255, 255)), Size=Slider(1.414, range=0..10))
move_6 = Move(Geometry=move_5.Geometry, Motion=amp_3)  # -> Geometry, Transform
entwine = Entwine(
    Branch00=move_2.Geometry,
    Branch01=move_3.Geometry,
    Branch02=move_4.Geometry,
    Branch03=move_5.Geometry,
    Branch04=move_6.Geometry,
    FlattenInputs=True)
tstat = TreeStatistics(Tree=entwine)  # -> Paths, Length, Count
volume_3 = Volume(Geometry=entwine)  # -> Volume, Centroid
series_4 = Series(Start=1, Step=Slider(0.2, range=0..5), Count=tstat.Count)
scale_2 = Scale(Geometry=entwine, Center=volume_3.Centroid, Factor=graft(series_4))  # -> simplify(Geometry), Transform
bang = ExplodeTree(Data=scale_2.Geometry)  # -> Branch0, Branch1, Branch2, Branch3, Branch4
entwine_2 = Entwine(
    Branch00=sdiff,
    Branch01=bang.Branch0,
    Branch02=bang.Branch1,
    Branch03=bang.Branch2,
    Branch04=bang.Branch3,
    Branch05=bang.Branch4,
    FlattenInputs=True)
brep_2 = Brep(flatten(scale.Geometry))
bbx = BrepBrep(BrepA=graft(entwine_2), BrepB=flatten(entwine_2))  # -> Curves, Points
wires = BrepWireframe(Brep=entwine_2, Density=Slider(50, range=-1..1000))
swatch = ColourSwatch(SwatchColor=RGB(8, 8, 8))
wires_2 = BrepWireframe(Brep=entwine_2, Density=-1)
brep_3 = Brep(brep)
wires_3 = BrepWireframe(Brep=brep_2, Density=-1)
wires_4 = BrepWireframe(Brep=brep_2, Density=Slider(12, range=-1..100))
number_slider_4 = Slider(4.33, range=0..10)
previewlw = CustomPreviewLineweights(Geometry=wires, Shader=ColourSwatch(SwatchColor=RGB(145, 145, 145)), Absolute=False)
preview = CustomPreview(Geometry=brep_2, Material=ColourSwatch(SwatchColor=RGBA(255, 255, 255, 134)))
preview_2 = CustomPreview(Geometry=entwine_2, Material=ColourSwatch(SwatchColor=RGBA(255, 255, 255, 161)))
preview_3 = CustomPreview(Geometry=brep_3, Material=ColourSwatch(SwatchColor=RGBA(0, 0, 0, 132)))
previewlw_2 = CustomPreviewLineweights(Geometry=wires_2, Shader=swatch, Thickness=Slider(3.744, range=0..10), Absolute=False)
previewlw_3 = CustomPreviewLineweights(Geometry=bbx.Curves, Shader=swatch, Thickness=Slider(2.066, range=0..10), Absolute=False)
previewlw_4 = CustomPreviewLineweights(Geometry=line, Shader=ColourSwatch(SwatchColor=RGB(255, 255, 255)), Absolute=False)
swatch_2 = ColourSwatch(SwatchColor=RGBA(255, 0, 187, 186))
previewlw_5 = CustomPreviewLineweights(Geometry=wires_4, Shader=swatch_2, Absolute=False)
previewlw_6 = CustomPreviewLineweights(Geometry=sec.Curves, Shader=swatch_2, Thickness=number_slider_4, Absolute=False)
previewlw_7 = CustomPreviewLineweights(Geometry=wires_3, Shader=swatch_2, Thickness=number_slider_4, Absolute=False)
wires_5 = BrepWireframe(Brep=brep_3, Density=Slider(4, range=-1..100))
previewmat = CustomPreviewMaterials(Geometry=brep_3, DiffuseColor=ColourSwatch(SwatchColor=RGB(8, 8, 8)), Transparency=Slider(0.878, range=0..1))
previewlw_8 = CustomPreviewLineweights(Geometry=wires_5, Shader=ColourSwatch(SwatchColor=RGBA(143, 143, 143, 186)), Absolute=False)
