# Grasshopper definition cmplx_surface.gh (Grasshopper 1.0.7)
# plug-ins: Human

number_slider = Slider(100, range=0..100)
box = CenterBox(Base=PlaneXY(0, 0, 0), X=number_slider, Y=number_slider, Z=number_slider)
debrep = DeconstructBrep(Brep=box)  # -> Faces, Edges, Vertices
area = Area(Geometry=debrep.Faces)  # -> Area, Centroid
pdecon = Deconstruct(Point=area.Centroid)  # -> XComponent, YComponent, ZComponent
sort = SortList(Keys=pdecon.ZComponent, ValuesA=debrep.Faces)  # -> Keys, ValuesA
area_2 = Area(Geometry=box)  # -> Area, Centroid
item = ListItem(List=sort.ValuesA, Index=0, Wrap=True)  # -> Item1, Item
area_3 = Area(Geometry=item.Item1)  # -> Area, Centroid
vec2pt = Vector2Pt(PointA=area_3.Centroid, PointB=area_2.Centroid, Unitize=False)  # -> Vector, Length
move = Move(Geometry=item.Item1, Motion=vec2pt.Vector)  # -> Geometry, Transform
merge = Merge(Data1=item.Item1, Data2=move.Geometry, Data3=item.Item)
lng = ListLength(List=merge)
random = Random(Range=Domain(0, 9999), Number=lng, Seed=Slider(1010, range=0..10000))
round = Round(Number=random)  # -> Nearest, Floor, Ceiling
area_4 = Area(Geometry=merge)  # -> Area, Centroid
popgeo = PopulateGeometry(Geometry=merge, Count=Slider(50, range=0..100), Seed=round.Floor)  # -> simplify(Population)
cir = Circle(Plane=area_4.Centroid, Radius="100")
alongcrv = SortAlongCurve(Points=popgeo, Curve=graft(cir))  # -> simplify(Points), Indices
nurbs = NurbsCurve(Vertices=alongcrv.Points, Degree=Slider(2, range=0..3), Periodic=invert(False))  # -> Curve, Length, Domain
loft = Loft(
    Curves=flatten(nurbs.Curve),
    Options={Adjust=False, Closed=False, LoftEnds=0, LoftSimp=0, LoftType=0, Rebuild=10, Refit=0.01})
Z = UnitZ(Factor=1)
contour = Contour(Shape=loft, Point=Point(0, 0, 0), Direction=Z, Distance=Slider(1.495, range=0.5..100))
srfsplit = SurfaceSplit(Surface=loft, Curves=flatten(contour))
edges = BrepEdges(Brep=srfsplit)  # -> Naked, Interior, NonManifold
join = JoinCurves(Curves=edges.Naked, Preserve=False)
area_5 = Area(Geometry=join)  # -> Area, Centroid
preview = CustomPreview(Geometry=srfsplit, Material=ColourSwatch(SwatchColor=RGB(255, 255, 255)))
preview_2 = CustomPreview(Geometry=srfsplit, Material=ColourSwatch(SwatchColor=RGB(0, 0, 0)))
scale = Scale(Geometry=join, Center=area_5.Centroid, Factor=Slider(1.002, range=0..5))  # -> Geometry, Transform
previewlw = CustomPreviewLineweights(
    Geometry=scale.Geometry,
    Shader=ColourSwatch(SwatchColor=RGB(153, 153, 153)),
    Thickness=Slider(1.163, range=0..10),
    Absolute=False)
