# Grasshopper definition cmplx_Fidenza.gh (Grasshopper 1.0.7)
# plug-ins: Human

number_slider = Slider(12, range=0..50)
# Script Title: Fidenza
# Created by: Michael Hoehn
# Last Modified: 220114
number_slider_2 = Slider(5, range=0..50)
sqgrid = Square(Plane=PlaneXY(0, 0, 0), Size=number_slider_2, ExtentX=number_slider, ExtentY=number_slider)  # -> Cells, flatten(Points)
number_slider_3 = Slider(9998, range=0..10000)
bbox = BoundingBox(Content=flatten(sqgrid.Cells), Plane=PlaneXY(0, 0, 0), UnionBox=True)  # -> Box, Box_2
pt = Point(sqgrid.Points)
pop2d = Populate2D(Region=bbox.Box, Count=Slider(3, range=0..25), Seed=number_slider_3)
fspin = SpinForce(Plane=pop2d, Strength=Slider(1, range=0..10), Radius=Slider(5, range=0..5), Decay=Slider(0.25, range=0..10))
mergef = MergeFields(Fields=fspin)
fline = FieldLine(Field=mergef, Point=pt, Steps=1000, Accuracy=0.1, Method=3)
cull = CullPattern(List=fline, CullPattern=[False, False, True, True])
eval = EvaluateCurve(Curve=reparameterize(fline), Parameter=Slider(1, range=0..1))  # -> Point, Tangent, Angle
number_slider_4 = Slider(0.113, range=0..10)
len = Length(Curve=fline)
Z = UnitZ(Factor=eval.Point)
amp = Amplitude(Vector=eval.Tangent, Amplitude=Slider(5.28, range=0..100))
bnd = Bounds(Numbers=len)
dom = ConstructDomain(DomainStart=0, DomainEnd=Slider(0.75, range=0..2))
vrot = Rotate(Vector=eval.Tangent, Axis=Z, Angle=degrees(Slider(90, range=0..100)))
rev = Reverse(Vector=vrot)
vdis = VectorDisplay(Anchor=eval.Point, Vector=amp)
remap = RemapNumbers(Value=len, Source=bnd, Target=dom)  # -> Mapped, Clipped
line = LineSDL(Start=eval.Point, Direction=rev, Length=remap.Mapped)
line_2 = LineSDL(Start=eval.Point, Direction=vrot, Length=remap.Mapped)
merge = Merge(Data1=line_2, Data2=line)
join = JoinCurves(Curves=merge, Preserve=False)  # -> graft(Curves)
rec = DataRecorder(join, DataLimit=-10, RecordData=True)
split_count = Slider(5, range=0..100)
geo = Geometry(simplify(rec))
tstat = TreeStatistics(Tree=geo)  # -> Paths, Length, Count
random = Random(Range=tstat.Length, Number=split_count, Seed=number_slider_3)
jitter = Jitter(List=random, Jitter=1, Seed=2)  # -> Values, Indices
round = Round(Number=jitter.Values)  # -> Nearest, Floor, Ceiling
loft = Loft(Curves=geo, Options={Adjust=False, Closed=False, LoftEnds=0, LoftSimp=0, LoftType=0, Rebuild=10, Refit=0.01})  # -> flatten(Loft)
item = ListItem(List=geo, Index=round.Floor, Wrap=True)
dedomain = DeconstructDomain(Domain=bnd)  # -> Start, End
dom_2 = ConstructDomain(DomainStart=0, DomainEnd=Slider(25, range=0..50))
remap_2 = RemapNumbers(Value=len, Source=bnd, Target=dom_2)  # -> Mapped, Clipped
gradient = Gradient(LowerLimit=dedomain.Start, UpperLimit=dedomain.End, Parameter=len, stops=[0.292: RGB(255, 255, 255), 1: RGB(0, 0, 0)])
Z_2 = UnitZ(Factor=remap_2.Mapped)
extr = Extrude(Base=loft, Direction=Z_2)
wires = BrepWireframe(Brep=extr, Density=-1)
preview = CustomPreview(Geometry=extr, Material=gradient)
previewlw = CustomPreviewLineweights(Geometry=wires, Shader=ColourSwatch(SwatchColor=RGB(82, 82, 82)), Absolute=False)
