# Grasshopper definition CustomCameraRig.gh (Grasshopper 1.0.7)

# ---- group: Camera Settings
# Script Title: Custom Camera Rig
# Created by: Michael Hoehn
# Last Modified: 220121
number_slider = Slider(307.735, range=0..1000)
number_slider_2 = Slider(270.841, range=0..1000)
number_slider_3 = Slider(683.89, range=0..10000)

# ----
current_frame = Slider(0, range=0..200)
frame_count = Slider(200, range=0..200)
start_point = Slider(0, range=0..100)
crv = Curve(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)
Z = UnitZ(Factor=number_slider)
Z_2 = UnitZ(Factor=number_slider_2)
area = Area(Geometry=crv)  # -> Area, Centroid
move = Move(Geometry=area.Centroid, Motion=Z)  # -> Geometry, Transform
cir = Circle(Plane=area.Centroid, Radius=number_slider_3)
move_2 = Move(Geometry=cir, Motion=Z_2)  # -> Geometry, Transform
divide = DivideCurve(Curve=move_2.Geometry, Count=frame_count, Kinks=False)  # -> Points, Tangents, Parameters
shift = ShiftList(List=divide.Points, Shift=start_point, Wrap=True)
item = ListItem(List=shift, Index=current_frame, Wrap=invert(True))
camera_custom = GhPythonScript(location=item, target=move.Geometry)  # -> out, a; inputs location: Point3d
# ---------- camera_custom: Python ----------
"""Description of Component.
    Inputs:
        x: The x script variable
        y: The y script variable
    Output:
        a: The a output variable"""

import rhinoscriptsyntax as rs
import scriptcontext as sc 

sc.doc = ghdoc

loc = rs.coerce3dpoint(location)
tar = rs.coerce3dpoint(target)

vp = ghdoc.Views.ActiveView.ActiveViewport
vp.SetCameraLocation(loc, False)
vp.SetCameraDirection(tar - loc, True)
# ---------- end camera_custom ----------
