# Grasshopper definition HighResViewCap.gh (Grasshopper 1.0.7)

max_frame_count = Slider(50, range=1..100)
domain_max = Slider(1, range=1..100)
# Script Title: Custom High-Res Recorder
# Created by: Michael Hoehn
# Last Modified: 220121
animation_slider = Slider(0, range=0..10)
dom = ConstructDomain(DomainStart="1", DomainEnd=max_frame_count)
dom_2 = ConstructDomain(DomainStart="0", DomainEnd=domain_max)
remap = RemapNumbers(Value=animation_slider, Source=dom_2, Target=dom)  # -> Mapped, Clipped
round = Round(Number=remap.Mapped)  # -> Nearest, Floor, Ceiling
high_res_view_cap = GhPythonScript(active=Toggle(False), filePath="E:\NFTs\Test\TestImage", frame=round.Floor)  # -> out, a; inputs frame: Int32
# ---------- high_res_view_cap: Python ----------
import rhinoscriptsyntax as rs

if active: 
    savedLocation = filePath + str(int(frame)).zfill(4) +".png"
    rs.Command("-ViewCaptureToFile \n\"" + savedLocation + "\"\n")
# ---------- end high_res_view_cap ----------
