# Grasshopper definition cmplx_Word Art.gh (Grasshopper 1.0.7)
# plug-ins: Human

crv = Curve(graft([<curve referenced from the Rhino model> x7]))
number_slider = Slider(5842, range=0..10000)
tstat = TreeStatistics(Tree=crv)  # -> Paths, Length, Count
dom = ConstructDomain(DomainStart=Slider(-0.683, range=-5..5), DomainEnd=Slider(0.216, range=-5..5))
Y = UnitY(Factor=1)
Z = UnitZ(Factor=1)
X = UnitX(Factor=1)
number_slider_2 = Slider(70, range=2..70)
random = Random(Range=dom, Number=tstat.Count, Seed=number_slider_2)
X_2 = UnitX(Factor=random)
move = Move(Geometry=crv, Motion=graft(X_2))  # -> Geometry, Transform
Z_2 = UnitZ(Factor=random)
move_2 = Move(Geometry=move.Geometry, Motion=graft(Z_2))  # -> Geometry, Transform
bang = ExplodeTree(Data=simplify(move_2.Geometry))  # -> Branch0, Branch1, Branch2, Branch3, Branch4, Branch5, Branch6
merge = Merge(
    Data1=bang.Branch0,
    Data2=bang.Branch1,
    Data3=bang.Branch2,
    Data4=bang.Branch3,
    Data5=bang.Branch4,
    Data6=bang.Branch5,
    Data7=bang.Branch6)  # -> flatten(Result)
loft = Loft(Curves=merge, Options={Adjust=False, Closed=False, LoftEnds=0, LoftSimp=0, LoftType=0, Rebuild=10, Refit=0.01})
cap = CapHoles(Brep=loft)
contour = Contour(Shape=cap, Point=Point(0, 0, 0), Direction=Y, Distance=Slider(0.025, range=0.001..10))  # -> simplify(Contours)
divide = DivideCurve(Curve=contour, Count=number_slider_2, Kinks=False)  # -> Points, Tangents, Parameters
srf = Surface(move_2.Geometry)
intcrv = Interpolate(Vertices=divide.Points, Degree=3, Periodic=invert(False), KnotStyle=1)  # -> Curve, Length, Domain
wires = BrepWireframe(Brep=srf, Density=-1)
preview = CustomPreview(Geometry=srf, Material=ColourSwatch(SwatchColor=RGB(255, 255, 255)))
tstat_2 = TreeStatistics(Tree=intcrv.Curve)  # -> Paths, Length, Count
sqrt = SquareRoot(Value=tstat_2.Count)
panel = Panel(tstat_2.Count)
previewlw = CustomPreviewLineweights(Geometry=wires, Shader=ColourSwatch(SwatchColor=RGB(0, 0, 0)), Thickness=Slider(5.274, range=0..10), Absolute=False)
area = Area(Geometry=intcrv.Curve)  # -> Area, Centroid
sqgrid = Square(Plane=PlaneXY(0, 0, 0), Size=1, ExtentX=sqrt, ExtentY=sqrt)  # -> Cells, Points
area_2 = Area(Geometry=sqgrid.Cells)  # -> Area, flatten(Centroid)
xz = XZPlane(Origin=area.Centroid)
orient = Orient(Geometry=intcrv.Curve, Source=xz, Target=graft(area_2.Centroid))  # -> Geometry, Transform
previewlw_2 = CustomPreviewLineweights(Geometry=intcrv.Curve, Shader=ColourSwatch(SwatchColor=RGB(115, 115, 115)), Absolute=False)
geo = Geometry(flatten(orient.Geometry))
len = Length(Curve=geo)
bnd = Bounds(Numbers=len)
dedomain = DeconstructDomain(Domain=bnd)  # -> Start, End
gradient = Gradient(LowerLimit=dedomain.Start, UpperLimit=dedomain.End, Parameter=len, stops=[0: RGB(189, 195, 199), 1: RGB(44, 62, 80)])
previewlw_3 = CustomPreviewLineweights(Geometry=geo, Shader=gradient, Thickness=Slider(5.274, range=0..10), Absolute=False)
